# Grasshopper definition ECOM_toolkit.gh (Grasshopper 1.0.8)
# Copyright: SS
# plug-ins: Human UI, Pufferfish, MetaHopper, Telepathy

panel = Panel("319775.38044, 6398000")

runopendss = DFRunOpenDSS()  # -> out, buildings, connectors, transformers; plug-in component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
elecconnect = DFElectricalConnector()  # -> connector; plug-in component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
transformer = DFTransformer()  # -> transformer; plug-in component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
substation = DFSubstation()  # -> substation; plug-in component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
network = DFElectricalNetwork()  # -> out, network; plug-in component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

fixedintervalschedule = HBFixedIntervalSchedule()  # -> out, schedule; disabled; plug-in component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
weeklyschedule = HBWeeklySchedule()  # -> out, schedule, idf_year, idf_week, idf_days; disabled; plug-in component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

panel_x = Slider(2, range=0..10)  # disabled
adjacent_panel_spacing = Slider(0.2, range=0..1)  # disabled
pv_angle = Slider(9, range=0..100)  # disabled
fraction_of_panels_to_remove = Slider(0.2, range=0..1)  # disabled
panel_y = Slider(1, range=0..1)  # disabled
panel_to_panel_spacing = Slider(1.5, range=0..10)  # disabled
surface = Surface()  # disabled
deconstruct_brep = DeconstructBrep(Brep=surface)  # -> Faces, Edges, Vertices; disabled
length = Length(Curve=deconstruct_brep.Edges)  # disabled
area = Area(Geometry=surface)  # -> Area, Centroid; disabled
highest_lowest_numbers = HighestLowestNumbers(Numbers=length)  # -> Highest, Lowest; disabled
evaluate_surface = EvaluateSurface(Point=area.Centroid)  # -> Point, Normal, UDirection, VDirection, Frame; disabled
member_index = MemberIndex(Set=length, Member=highest_lowest_numbers.Highest)  # -> Index, Count; disabled
list_item = ListItem(List=deconstruct_brep.Edges, Index=member_index.Index, Wrap=True)  # disabled
cross_product = CrossProduct(VectorA=evaluate_surface.Normal, VectorB=list_item, Unitize=False)  # -> Vector, Length; disabled
contour = Contour(Shape=surface, Point=area.Centroid, Direction=cross_product.Vector, Distance=panel_to_panel_spacing)  # -> reparameterize(Contours); disabled
addition = Addition(A=panel_x, B=adjacent_panel_spacing)  # disabled
divide_distance = DivideDistance(Curve=flatten(contour), Distance=addition)  # -> Points, Tangents, Parameters; disabled
unit_vector = UnitVector(Vector=list_item)  # disabled
radians = Radians(Degrees=pv_angle)  # disabled
panel_2 = Panel("0")  # disabled
xz_plane = XZPlane(Origin=Point(0, 0, 0))  # disabled
cull_index = CullIndex(List=divide_distance.Points, Indices=panel_2, Wrap=True)  # disabled
multiplication = Multiplication(A=unit_vector, B=panel_x)  # disabled
rectangle = Rectangle(Plane=PlaneXY(0, 0, 0), XSize=panel_y, YSize=panel_x, Radius=0)  # -> Rectangle, Length; disabled
rotate = Rotate(Geometry=rectangle.Rectangle, Angle=radians, Plane=xz_plane)  # -> Geometry, Transform; disabled
negative = Negative(Value=multiplication)  # disabled
boundary_surfaces = BoundarySurfaces(Edges=rotate.Geometry)  # disabled
move = Move(Geometry=cull_index, Motion=negative)  # -> Geometry, Transform; disabled
point = Point(Point(0, 0, 0))  # disabled
unit_x = UnitX(Factor=1)  # disabled
vector_2pt = Vector2Pt(PointA=point, PointB=flatten(cull_index), Unitize=False)  # -> Vector, Length; disabled
angle = Angle(VectorA=unit_x, VectorB=cross_product.Vector)  # -> Angle, Reflex; disabled
move_2 = Move(Motion=vector_2pt.Vector)  # -> Geometry, flatten(Transform); disabled
rotate_2 = Rotate(Angle=angle.Angle, Plane=PlaneXY(0, 0, 0))  # -> Geometry, Transform; disabled
list_length = ListLength(List=move_2.Transform)  # disabled
duplicate_data = DuplicateData(Data=rotate_2.Transform, Number=list_length, Order=True)  # -> flatten(Data); disabled
entwine = Entwine(Branch00=duplicate_data, Branch01=move_2.Transform, FlattenInputs=True)  # disabled
flip_matrix = FlipMatrix(Data=entwine)  # disabled
compound = Compound(Transforms=flip_matrix)  # -> flatten(Compound); disabled
transform = Transform(Geometry=boundary_surfaces, Transform=compound)  # disabled
list_length_2 = ListLength(List=transform)  # disabled
colour_swatch = ColourSwatch(SwatchColor=RGB(108, 108, 189))  # disabled
multiplication_2 = Multiplication(A=list_length_2, B=fraction_of_panels_to_remove)  # disabled
random_reduce = RandomReduce(List=transform, Reduction=multiplication_2, Seed=1)  # disabled
custom_preview = CustomPreview(Geometry=random_reduce, Material=colour_swatch)  # disabled

# ---- group: Roof
roof_y = Slider(10, range=0..10)  # disabled
roof_x = Slider(26, range=0..100)  # disabled
roof_angle = Slider(20, range=0..100)  # disabled
roof_angle_2 = RemoteSender(roof_angle)  # disabled
roof_x_2 = RemoteSender(roof_x)  # disabled
roof_y_2 = RemoteSender(roof_y)  # disabled

# ---- group: Roof surface
roof_angle_3 = RemoteReceiver(roof_angle_2)  # disabled
roof_y_3 = RemoteReceiver(roof_y_2)  # disabled
roof_x_3 = RemoteReceiver(roof_x_2)  # disabled
panel_3 = Panel("90")  # disabled
unit_x_2 = UnitX(Factor=roof_x_3)  # disabled
subtraction = Subtraction(A=panel_3, B=roof_angle_3)  # disabled
point_2 = Point(Point(0, 0, 1.763293965))  # disabled
move_3 = Move(Geometry=point_2, Motion=unit_x_2)  # -> Geometry, Transform; disabled
radians_2 = Radians(Degrees=subtraction)  # disabled
unit_z = UnitZ(Factor=roof_y_3)  # disabled
unit_x_3 = UnitX(Factor=1)  # disabled
line = Line(StartPoint=point_2, EndPoint=move_3.Geometry)  # disabled
rotate_3 = Rotate(Vector=unit_z, Axis=unit_x_3, Angle=radians_2)  # disabled
extrude = Extrude(Base=line, Direction=rotate_3)  # disabled
roof_geometry = RemoteSender(extrude)  # disabled

# ----
panel_4 = Panel(area.Centroid)

pvmodule = PVModule(
    name="MC2 350W Panel",
    rating=Slider(350, range=0..1000),
    size_x=Slider(1, range=0..1),
    size_y=Slider(2, range=0..10),
    cost=Slider(3100, range=0..10000),
    embodied_co2=Slider(615, range=0..1000))  # -> out, PV_module, efficiency, area, total_cost, total_embodied_co2
# ---------- pvmodule: Python ----------
#! python3
# r: pandas, numpy, networkx

ghenv.Component.Name = 'PVModule'
ghenv.Component.NickName = 'PVModule'
ghenv.Component.Message = '0.0.1'
ghenv.Component.Category = 'ECOM4Future'
ghenv.Component.SubCategory = '1 :: Entities'
ghenv.Component.AdditionalHelpFromDocStrings = '2'

from ECOMToolkit.entities import PVModule
# --- Main Grasshopper Logic ---
PV_module = PVModule(name, rating, size_x, size_y, cost, embodied_co2)
report = PV_module.validate()
efficiency = PV_module.efficiency
area = PV_module.area
total_cost = PV_module.total_cost
total_embodied_co2 = PV_module.total_embodied_co2
# ---------- end pvmodule ----------
panel_5 = Panel(pvmodule.PV_module)

pvmodule_2 = PVModule(
    name="MC2 350W Panel",
    rating=Slider(350, range=0..1000),
    size_x=Slider(1, range=0..1),
    size_y=Slider(2, range=0..10),
    cost=Slider(3100, range=0..10000),
    embodied_co2=Slider(615, range=0..1000))  # -> out, PV_module, efficiency, area, total_cost, total_embodied_co2; same code as pvmodule
panel_6 = Panel(pvmodule_2.PV_module)

pvmodule_3 = PVModule(
    name="MC2 350W Panel",
    rating=Slider(350, range=0..1000),
    size_x=Slider(1, range=0..1),
    size_y=Slider(2, range=0..10),
    cost=Slider(3100, range=0..10000),
    embodied_co2=Slider(615, range=0..1000))  # -> out, PV_module, efficiency, area, total_cost, total_embodied_co2; same code as pvmodule
panel_7 = Panel(pvmodule_3.PV_module)

pvmodule_4 = PVModule(
    name="Default 400W Panel",
    rating=Slider(400, range=0..1000),
    size_x=Slider(1, range=0..1),
    size_y=Slider(2, range=0..10),
    cost=Slider(3100, range=0..10000),
    embodied_co2=Slider(615, range=0..1000))  # -> out, PV_module, efficiency, area, total_cost, total_embodied_co2; same code as pvmodule
panel_8 = Panel(pvmodule_4.PV_module)

pvmodule_5 = PVModule(
    name="MC2 350W Panel",
    rating=Slider(350, range=0..1000),
    size_x=Slider(1, range=0..1),
    size_y=Slider(2, range=0..10),
    cost=Slider(3100, range=0..10000),
    embodied_co2=Slider(615, range=0..1000))  # -> out, PV_module, efficiency, area, total_cost, total_embodied_co2; same code as pvmodule
panel_9 = Panel(pvmodule_5.PV_module)

pvmodule_6 = PVModule(
    name="MC2 350W Panel",
    rating=Slider(350, range=0..1000),
    size_x=Slider(1, range=0..1),
    size_y=Slider(2, range=0..10),
    cost=Slider(3100, range=0..10000),
    embodied_co2=Slider(615, range=0..1000))  # -> out, PV_module, efficiency, area, total_cost, total_embodied_co2; same code as pvmodule
panel_10 = Panel(pvmodule_6.PV_module)

pvmodule_7 = PVModule(
    name="MC2 350W Panel",
    rating=Slider(350, range=0..1000),
    size_x=Slider(1, range=0..1),
    size_y=Slider(2, range=0..10),
    cost=Slider(3100, range=0..10000),
    embodied_co2=Slider(615, range=0..1000))  # -> out, PV_module, efficiency, area, total_cost, total_embodied_co2; same code as pvmodule
panel_11 = Panel(pvmodule_7.PV_module)

pvmodule_8 = PVModule(
    name="MC2 350W Panel",
    rating=Slider(350, range=0..1000),
    size_x=Slider(1, range=0..1),
    size_y=Slider(2, range=0..10),
    cost=Slider(3100, range=0..10000),
    embodied_co2=Slider(615, range=0..1000))  # -> out, PV_module, efficiency, area, total_cost, total_embodied_co2; same code as pvmodule
panel_12 = Panel(pvmodule_8.PV_module)

surface_2 = Surface(<surface referenced from the Rhino model>)
pvplant = PVPlant(
    name="AWL-PV",
    surfaces=surface_2,
    PV_module=pvmodule.PV_module,
    percentage=Slider(90, range=0..100),
    system_loss=Slider(14, range=0..100),
    run=Toggle(True))  # -> out, report, PV_plant, azimuth, slope, number_panels, installed_capacity, total_cost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; inputs surfaces: list of Brep
# ---------- pvplant: Python ----------
# PVGIS: A Plugin for PV Plant Production Analysis (MIT)
# Version: 0.1.3
# Designed for use inside Grasshopper (GH) for Rhino by ECOM4Future

ghenv.Component.Name = 'PVPlant'
ghenv.Component.NickName = 'PVPlant'
ghenv.Component.Message = '0.0.1'
ghenv.Component.Category = 'ECOM4Future'
ghenv.Component.SubCategory = '1 :: Entities'
ghenv.Component.AdditionalHelpFromDocStrings = '2'

import pandas as pd
from ECOMToolkit.entities import PVPlant

# --- Grasshopper Main Logic ---
if run and surfaces is not None:
    # Ensure PV_module and percentage are lists matching surfaces
    if not isinstance(PV_module, list):
        PV_module = [PV_module] * len(surfaces)
    elif len(PV_module) != len(surfaces):
        raise ValueError("PV_module list must match surfaces list length.")

    if not isinstance(percentage, list):
        percentage = [percentage] * len(surfaces)
    elif len(percentage) != len(surfaces):
        raise ValueError("Percentage list must match surfaces list length.")

    PV_plant, report = [], []
    slope, azimuth, installed_capacity = [], [], []
    number_panels, total_cost, total_embodied_co2 = [], [], []
    annual_production, hourly_result = [], []
    combined_dfs = []

    for i, srf in enumerate(surfaces):
        plant_name = "{}_{}".format(name_, i + 1) if len(surfaces) > 1 else name_
        plant = PVPlant(
            name=plant_name,
            surface=srf,
            pv_module=PV_module[i],
            percentage=percentage[i],
            system_loss=system_loss,  # now explicitly in %
            lat=lat,
            lon=lon,
            custom_slope=custom_slope
        )

        PV_plant.append(plant)
        report.append(plant.validate())
        slope.append(plant.slope)
        azimuth.append(plant.azimuth)
        installed_capacity.append(plant.installed_capacity)
        number_panels.append(plant.module_count)
        total_cost.append(plant.total_cost)
        total_embodied_co2.append(plant.total_embodied_co2)
        annual_production.append(plant.annual_production)
        hourly_result.append(plant.hourly_result)
        if not plant.hourly_df.empty:
            combined_dfs.append(plant.hourly_df)

    # Combine all hourly DataFrames into one, if any exist
    if combined_dfs:
        hourly_dataframe_combined = pd.concat(combined_dfs, ignore_index=True)
    else:
        hourly_dataframe_combined = pd.DataFrame()
else:
    report = []
    PV_plant = []
    azimuth = []
    slope = []
    number_panels = []
    installed_capacity = []
    total_cost = []
    total_embodied_co2 = []
    annual_production = []
    hourly_dataframes = []
    hourly_dataframe_combined = pd.DataFrame()
# ---------- end pvplant ----------
mass_addition = MassAddition(Input=pvplant.number_panels)  # -> Result, PartialResults
panel_13 = Panel(mass_addition.Result)

surface_3 = Surface([<surface referenced from the Rhino model> x6])
pvplant_2 = PVPlant(
    name="Kemi-PV",
    surfaces=surface_3,
    PV_module=pvmodule_2.PV_module,
    percentage=Slider(90, range=0..100),
    system_loss=Slider(14, range=0..100),
    run=Toggle(True))  # -> out, report, PV_plant, azimuth, slope, number_panels, installed_capacity, total_cost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; inputs surfaces: list of Brep; same code as pvplant
mass_addition_2 = MassAddition(Input=pvplant_2.number_panels)  # -> Result, PartialResults
panel_14 = Panel(mass_addition_2.Result)

surface_4 = Surface(<surface referenced from the Rhino model>)
pvplant_3 = PVPlant(
    name="Bibliotek-PV",
    surfaces=surface_4,
    PV_module=pvmodule_3.PV_module,
    percentage=Slider(70, range=0..100),
    system_loss=Slider(14, range=0..100),
    run=Toggle(True))  # -> out, report, PV_plant, azimuth, slope, number_panels, installed_capacity, total_cost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; inputs surfaces: list of Brep; same code as pvplant
mass_addition_3 = MassAddition(Input=pvplant_3.number_panels)  # -> Result, PartialResults
panel_15 = Panel(mass_addition_3.Result)

surface_5 = Surface([<surface referenced from the Rhino model> x2])
pvplant_4 = PVPlant(
    name="SB2-PV",
    surfaces=surface_5,
    PV_module=pvmodule_4.PV_module,
    percentage=Slider(93, range=0..100),
    system_loss=Slider(14, range=0..100),
    run=Toggle(True))  # -> out, report, flatten(PV_plant), azimuth, slope, number_panels, installed_capacity, total_cost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; inputs surfaces: list of Brep; same code as pvplant
panel_16 = Panel(pvplant_4.hourly_result)

surface_6 = Surface([<surface referenced from the Rhino model> x2])
pvplant_5 = PVPlant(
    name="Edit-PV",
    surfaces=surface_6,
    PV_module=pvmodule_5.PV_module,
    percentage=Slider(70, range=0..100),
    system_loss=Slider(14, range=0..100),
    run=Toggle(True))  # -> out, report, flatten(PV_plant), azimuth, slope, number_panels, installed_capacity, total_cost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; inputs surfaces: list of Brep; same code as pvplant
mass_addition_4 = MassAddition(Input=pvplant_5.number_panels)  # -> Result, PartialResults
panel_17 = Panel(mass_addition_4.Result)

surface_7 = Surface([<surface referenced from the Rhino model> x20])
pvplant_6 = PVPlant(
    name="MC2-PV",
    surfaces=surface_7,
    PV_module=pvmodule_6.PV_module,
    percentage=Slider(23, range=0..100),
    system_loss=Slider(14, range=0..100),
    run=Toggle(True))  # -> out, report, PV_plant, azimuth, slope, number_panels, installed_capacity, total_cost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; inputs surfaces: list of Brep; same code as pvplant
mass_addition_5 = MassAddition(Input=pvplant_6.number_panels)  # -> Result, PartialResults
panel_18 = Panel(mass_addition_5.Result)

curve = Curve(<curve referenced from the Rhino model>)
panel_19 = Panel("E:\DT4PED\DT4PED_Campus\Data\energy_data\fysik origo\fysik_orgio_electricity_2022.csv")
user_text = UserText(Content=curve, Keys="number_of_floors", UserTextMode=1)  # -> Content, Keys, Values
hb_building_programs = HBBuildingPrograms({"LargeOffice", "MediumOffice", "SmallOffice", "MidriseApartment", "HighriseApartment", "Retail", "StripMall", "PrimarySchool", "SecondarySchool", "SmallHotel", "LargeHotel", "Hospital", "Outpatient", "Laboratory", "Warehouse", "SuperMarket", "FullServiceRestaurant", "QuickServiceRestaurant", "Courthouse", "College", "LargeDataCenterHighITE", "LargeDataCenterLowITE", "SmallDataCenterHighITE", "SmallDataCenterLowITE"}, selected="College")
value_list = ValueList({"Akademiska Hus", "Studentbostäder", "Chalmersfastigheter"}, selected="Akademiska Hus")
brep = Brep(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)
building = Building(name="Fysik origo", owner=value_list, breps=flatten(brep), building_type=hb_building_programs, electric_demand=panel_19)  # -> out, building, area, fractional_hourly_electric_demand, electric_demand_from_program, electric_demand, total_energy_demand, total_installed_capacity; inputs footprints: list of Curve, number_of_floors: list, breps: list, PV_plant: list
# ---------- building: Python ----------
# Building: Honeybee-Compatible Building Entity (MIT)
# Version: 0.0.7 (Added Owner Input)
# Designed for use inside Grasshopper (GH) for Rhino by ECOM4Future

"""
Create a Honeybee-compatible Building object for energy community simulations.
_

    Args:
        name: Building name or ID (string).
        footprint: Rhino Brep or Surface representing the building footprint or 3D volume.
        building_type: Honeybee building program type (e.g., "MidriseApartment", "SmallOffice").
        occupancy_schedule: Honeybee ScheduleRuleset or ScheduleFixedInterval.
            (Optional) Can be converted to a pandas DataFrame via `convert_schedule_to_df=True`.
        electric_demand: List of 8760 hourly values (kWh), a CSV file path, or annual demand (kWh/year).
        construction_embodied_co2: Embodied CO₂ of construction (kgCO2e/m² or total kgCO2e).
        PV_plant: One or more PV Plant objects (from the PV Plant component).
        Battery: One or more Battery objects (from the Battery component).
        owner: Owner of the building. Must be one of:
            "Akademiska Hus", "Studentbostäder", "Chalmersfastigheter"
        convert_schedule_to_df: (Optional) Boolean to convert schedule to pandas DataFrame.

    Returns:
        report: Validation message.
        building: Building object (to pass into merge component).
        total_energy_demand: Total electric demand (kWh/year).
        total_pv_capacity: Total installed PV capacity (kW).
        total_installed_capacity: Combined PV + battery capacity (kW + kWh).
        total_embodied_co2: Total embodied CO₂ of the building (kgCO2e).
"""

ghenv.Component.Name = 'Building'
ghenv.Component.NickName = 'Building'
ghenv.Component.Message = '0.0.1'
ghenv.Component.Category = 'ECOM4Future'
ghenv.Component.SubCategory = 'Entities'
ghenv.Component.AdditionalHelpFromDocStrings = '2'

from ECOMToolkit.entities import Building
# --- Main Grasshopper Logic ---

building = Building(
    name, footprints, building_type,
    occupancy_schedule, electric_demand, PV_plant,
    owner, convert_schedule_to_df=False, breps=breps,number_of_floors=number_of_floors
)
report = building.validate()
electric_demand = building.electric_demand
total_energy_demand = building.total_energy_demand
total_pv_capacity = building.total_pv_capacity
total_installed_capacity = building.total_installed_capacity
area = building.area
fractional_hourly_electric_demand = building.fractional_hourly_electric_demand
electric_demand_from_program = building.electric_demand_from_program
# ---------- end building ----------
panel_20 = Panel(building.fractional_hourly_electric_demand)
panel_21 = Panel(building.electric_demand)
panel_22 = Panel(building.building)
panel_23 = Panel(building.electric_demand_from_program)

hb_building_programs_2 = HBBuildingPrograms({"LargeOffice", "MediumOffice", "SmallOffice", "MidriseApartment", "HighriseApartment", "Retail", "StripMall", "PrimarySchool", "SecondarySchool", "SmallHotel", "LargeHotel", "Hospital", "Outpatient", "Laboratory", "Warehouse", "SuperMarket", "FullServiceRestaurant", "QuickServiceRestaurant", "Courthouse", "College", "LargeDataCenterHighITE", "LargeDataCenterLowITE", "SmallDataCenterHighITE", "SmallDataCenterLowITE"}, selected="College")
curve_2 = Curve(<curve referenced from the Rhino model>)
value_list_2 = ValueList({"Akademiska Hus", "Studentbostäder", "Chalmersfastigheter"}, selected="Studentbostäder")
user_text_2 = UserText(Content=curve_2, Keys="number_of_floors", UserTextMode=1)  # -> Content, Keys, Values
brep_2 = Brep(<brep referenced from the Rhino model>)
building_2 = Building(
    name="Kemi",
    owner=value_list_2,
    breps=flatten(brep_2),
    building_type=hb_building_programs_2,
    electric_demand="E:\DT4PED\DT4PED_Campus\Data\energy_data\Vasa_15_2022.csv",
    PV_plant=pvplant_2.PV_plant)  # -> out, building, area, fractional_hourly_electric_demand, electric_demand_from_program, electric_demand, total_energy_demand, total_installed_capacity; inputs footprints: list of Curve, number_of_floors: list, breps: list, PV_plant: list; same code as building
panel_24 = Panel(building_2.electric_demand_from_program)
panel_25 = Panel(building_2.building)
panel_26 = Panel(building_2.electric_demand)
panel_27 = Panel(building_2.fractional_hourly_electric_demand)

panel_28 = Panel("E:\DT4PED\DT4PED_Campus\Data\energy_data\IT\electricity_2022.csv")
hb_building_programs_3 = HBBuildingPrograms({"LargeOffice", "MediumOffice", "SmallOffice", "MidriseApartment", "HighriseApartment", "Retail", "StripMall", "PrimarySchool", "SecondarySchool", "SmallHotel", "LargeHotel", "Hospital", "Outpatient", "Laboratory", "Warehouse", "SuperMarket", "FullServiceRestaurant", "QuickServiceRestaurant", "Courthouse", "College", "LargeDataCenterHighITE", "LargeDataCenterLowITE", "SmallDataCenterHighITE", "SmallDataCenterLowITE"}, selected="LargeDataCenterHighITE")
value_list_3 = ValueList({"Akademiska Hus", "Studentbostäder", "Chalmersfastigheter"}, selected="Studentbostäder")
curve_3 = Curve(<curve referenced from the Rhino model>)
user_text_3 = UserText(Content=curve_3, Keys="number_of_floors", UserTextMode=1)  # -> Content, Keys, Values
brep_3 = Brep(<brep referenced from the Rhino model>)
building_3 = Building(name="IT", owner=value_list_3, breps=flatten(brep_3), building_type=hb_building_programs_3, electric_demand=panel_28)  # -> out, building, area, fractional_hourly_electric_demand, electric_demand_from_program, electric_demand, total_energy_demand, total_installed_capacity; inputs footprints: list of Curve, number_of_floors: list, breps: list; same code as building
panel_29 = Panel(building_3.building)
panel_30 = Panel(building_3.electric_demand_from_program)
panel_31 = Panel(building_3.electric_demand)
panel_32 = Panel(building_3.fractional_hourly_electric_demand)

hb_building_programs_4 = HBBuildingPrograms({"LargeOffice", "MediumOffice", "SmallOffice", "MidriseApartment", "HighriseApartment", "Retail", "StripMall", "PrimarySchool", "SecondarySchool", "SmallHotel", "LargeHotel", "Hospital", "Outpatient", "Laboratory", "Warehouse", "SuperMarket", "FullServiceRestaurant", "QuickServiceRestaurant", "Courthouse", "College", "LargeDataCenterHighITE", "LargeDataCenterLowITE", "SmallDataCenterHighITE", "SmallDataCenterLowITE"}, selected="College")
curve_4 = Curve(<curve referenced from the Rhino model>)
value_list_4 = ValueList({"Akademiska Hus", "Studentbostäder", "Chalmersfastigheter"}, selected="Studentbostäder")
user_text_4 = UserText(Content=curve_4, Keys="number_of_floors", UserTextMode=1)  # -> Content, Keys, Values
brep_4 = Brep(<brep referenced from the Rhino model>)
building_4 = Building(
    name="Vasa 15",
    owner=value_list_4,
    breps=flatten(brep_4),
    building_type=hb_building_programs_4,
    electric_demand="E:\DT4PED\DT4PED_Campus\Data\energy_data\Vasa_15_2022.csv")  # -> out, building, area, fractional_hourly_electric_demand, electric_demand_from_program, electric_demand, total_energy_demand, total_installed_capacity; inputs footprints: list of Curve, number_of_floors: list, breps: list, PV_plant: list; same code as building
panel_33 = Panel(building_4.building)
panel_34 = Panel(building_4.electric_demand_from_program)
panel_35 = Panel(building_4.electric_demand)
panel_36 = Panel(building_4.fractional_hourly_electric_demand)

panel_37 = Panel("E:\DT4PED\DT4PED_Campus\Data\energy_data\Elkraftteknik\electricity_2022.csv")
hb_building_programs_5 = HBBuildingPrograms({"LargeOffice", "MediumOffice", "SmallOffice", "MidriseApartment", "HighriseApartment", "Retail", "StripMall", "PrimarySchool", "SecondarySchool", "SmallHotel", "LargeHotel", "Hospital", "Outpatient", "Laboratory", "Warehouse", "SuperMarket", "FullServiceRestaurant", "QuickServiceRestaurant", "Courthouse", "College", "LargeDataCenterHighITE", "LargeDataCenterLowITE", "SmallDataCenterHighITE", "SmallDataCenterLowITE"}, selected="College")
value_list_5 = ValueList({"Akademiska Hus", "Studentbostäder", "Chalmersfastigheter"}, selected="Studentbostäder")
curve_5 = Curve(<curve referenced from the Rhino model>)
user_text_5 = UserText(Content=curve_5, Keys="number_of_floors", UserTextMode=1)  # -> Content, Keys, Values
brep_5 = Brep(<brep referenced from the Rhino model>)
building_5 = Building(
    name="Elkraftteknik",
    owner=value_list_5,
    footprints=flatten(user_text_5.Content),
    number_of_floors=flatten(user_text_5.Values),
    breps=flatten(brep_5),
    building_type=hb_building_programs_5,
    electric_demand=panel_37)  # -> out, building, area, fractional_hourly_electric_demand, electric_demand_from_program, electric_demand, total_energy_demand, total_installed_capacity; inputs footprints: list of Curve, number_of_floors: list, breps: list; same code as building
panel_38 = Panel(building_5.building)
panel_39 = Panel(building_5.electric_demand_from_program)
panel_40 = Panel(building_5.electric_demand)
panel_41 = Panel(building_5.fractional_hourly_electric_demand)

hb_building_programs_6 = HBBuildingPrograms({"LargeOffice", "MediumOffice", "SmallOffice", "MidriseApartment", "HighriseApartment", "Retail", "StripMall", "PrimarySchool", "SecondarySchool", "SmallHotel", "LargeHotel", "Hospital", "Outpatient", "Laboratory", "Warehouse", "SuperMarket", "FullServiceRestaurant", "QuickServiceRestaurant", "Courthouse", "College", "LargeDataCenterHighITE", "LargeDataCenterLowITE", "SmallDataCenterHighITE", "SmallDataCenterLowITE"}, selected="College")
curve_6 = Curve(<curve referenced from the Rhino model>)
value_list_6 = ValueList({"Akademiska Hus", "Studentbostäder", "Chalmersfastigheter"}, selected="Studentbostäder")
user_text_6 = UserText(Content=curve_6, Keys="number_of_floors", UserTextMode=1)  # -> Content, Keys, Values
brep_6 = Brep(<brep referenced from the Rhino model>)
building_6 = Building(
    name="Vasa 13",
    owner=value_list_6,
    breps=flatten(brep_6),
    building_type=hb_building_programs_6,
    electric_demand="E:\DT4PED\DT4PED_Campus\Data\energy_data\Vasa_13_2022.csv")  # -> out, building, area, fractional_hourly_electric_demand, electric_demand_from_program, electric_demand, total_energy_demand, total_installed_capacity; inputs footprints: list of Curve, number_of_floors: list, breps: list, PV_plant: list; same code as building
panel_42 = Panel(building_6.building)
panel_43 = Panel(building_6.electric_demand_from_program)
panel_44 = Panel(building_6.electric_demand)
panel_45 = Panel(building_6.fractional_hourly_electric_demand)

hb_building_programs_7 = HBBuildingPrograms({"LargeOffice", "MediumOffice", "SmallOffice", "MidriseApartment", "HighriseApartment", "Retail", "StripMall", "PrimarySchool", "SecondarySchool", "SmallHotel", "LargeHotel", "Hospital", "Outpatient", "Laboratory", "Warehouse", "SuperMarket", "FullServiceRestaurant", "QuickServiceRestaurant", "Courthouse", "College", "LargeDataCenterHighITE", "LargeDataCenterLowITE", "SmallDataCenterHighITE", "SmallDataCenterLowITE"}, selected="College")
curve_7 = Curve(<curve referenced from the Rhino model>)
value_list_7 = ValueList({"Akademiska Hus", "Studentbostäder", "Chalmersfastigheter"}, selected="Studentbostäder")
user_text_7 = UserText(Content=curve_7, Keys="number_of_floors", UserTextMode=1)  # -> Content, Keys, Values
brep_7 = Brep(<brep referenced from the Rhino model>)
building_7 = Building(
    name="Vasa 12",
    owner=value_list_7,
    breps=flatten(brep_7),
    building_type=hb_building_programs_7,
    electric_demand="E:\DT4PED\DT4PED_Campus\Data\energy_data\Vasa_12_2022.csv")  # -> out, building, area, fractional_hourly_electric_demand, electric_demand_from_program, electric_demand, total_energy_demand, total_installed_capacity; inputs footprints: list of Curve, number_of_floors: list, breps: list, PV_plant: list; same code as building
panel_46 = Panel(building_7.building)
panel_47 = Panel(building_7.electric_demand_from_program)
panel_48 = Panel(building_7.electric_demand)
panel_49 = Panel(building_7.fractional_hourly_electric_demand)

hb_building_programs_8 = HBBuildingPrograms({"LargeOffice", "MediumOffice", "SmallOffice", "MidriseApartment", "HighriseApartment", "Retail", "StripMall", "PrimarySchool", "SecondarySchool", "SmallHotel", "LargeHotel", "Hospital", "Outpatient", "Laboratory", "Warehouse", "SuperMarket", "FullServiceRestaurant", "QuickServiceRestaurant", "Courthouse", "College", "LargeDataCenterHighITE", "LargeDataCenterLowITE", "SmallDataCenterHighITE", "SmallDataCenterLowITE"}, selected="College")
curve_8 = Curve(<curve referenced from the Rhino model>)
value_list_8 = ValueList({"Akademiska Hus", "Studentbostäder", "Chalmersfastigheter"}, selected="Studentbostäder")
user_text_8 = UserText(Content=curve_8, Keys="number_of_floors", UserTextMode=1)  # -> Content, Keys, Values
brep_8 = Brep(<brep referenced from the Rhino model>)
building_8 = Building(
    name="Vasa 11",
    owner=value_list_8,
    breps=flatten(brep_8),
    building_type=hb_building_programs_8,
    electric_demand="E:\DT4PED\DT4PED_Campus\Data\energy_data\Vasa_11_2022.csv")  # -> out, building, area, fractional_hourly_electric_demand, electric_demand_from_program, electric_demand, total_energy_demand, total_installed_capacity; inputs footprints: list of Curve, number_of_floors: list, breps: list, PV_plant: list; same code as building
panel_50 = Panel(building_8.building)
panel_51 = Panel(building_8.electric_demand_from_program)
panel_52 = Panel(building_8.electric_demand)
panel_53 = Panel(building_8.fractional_hourly_electric_demand)

hb_building_programs_9 = HBBuildingPrograms({"LargeOffice", "MediumOffice", "SmallOffice", "MidriseApartment", "HighriseApartment", "Retail", "StripMall", "PrimarySchool", "SecondarySchool", "SmallHotel", "LargeHotel", "Hospital", "Outpatient", "Laboratory", "Warehouse", "SuperMarket", "FullServiceRestaurant", "QuickServiceRestaurant", "Courthouse", "College", "LargeDataCenterHighITE", "LargeDataCenterLowITE", "SmallDataCenterHighITE", "SmallDataCenterLowITE"}, selected="College")
curve_9 = Curve(<curve referenced from the Rhino model>)
value_list_9 = ValueList({"Akademiska Hus", "Studentbostäder", "Chalmersfastigheter"}, selected="Studentbostäder")
user_text_9 = UserText(Content=curve_9, Keys="number_of_floors", UserTextMode=1)  # -> Content, Keys, Values
brep_9 = Brep(<brep referenced from the Rhino model>)
building_9 = Building(
    name="Vasa 9",
    owner=value_list_9,
    breps=flatten(brep_9),
    building_type=hb_building_programs_9,
    electric_demand="E:\DT4PED\DT4PED_Campus\Data\energy_data\Vasa_9_2022.csv")  # -> out, building, area, fractional_hourly_electric_demand, electric_demand_from_program, electric_demand, total_energy_demand, total_installed_capacity; inputs footprints: list of Curve, number_of_floors: list, breps: list, PV_plant: list; same code as building
panel_54 = Panel(building_9.building)
panel_55 = Panel(building_9.electric_demand_from_program)
panel_56 = Panel(building_9.electric_demand)
panel_57 = Panel(building_9.fractional_hourly_electric_demand)

hb_building_programs_10 = HBBuildingPrograms({"LargeOffice", "MediumOffice", "SmallOffice", "MidriseApartment", "HighriseApartment", "Retail", "StripMall", "PrimarySchool", "SecondarySchool", "SmallHotel", "LargeHotel", "Hospital", "Outpatient", "Laboratory", "Warehouse", "SuperMarket", "FullServiceRestaurant", "QuickServiceRestaurant", "Courthouse", "College", "LargeDataCenterHighITE", "LargeDataCenterLowITE", "SmallDataCenterHighITE", "SmallDataCenterLowITE"}, selected="College")
curve_10 = Curve(<curve referenced from the Rhino model>)
value_list_10 = ValueList({"Akademiska Hus", "Studentbostäder", "Chalmersfastigheter"}, selected="Studentbostäder")
user_text_10 = UserText(Content=curve_10, Keys="number_of_floors", UserTextMode=1)  # -> Content, Keys, Values
brep_10 = Brep(<brep referenced from the Rhino model>)
building_10 = Building(
    name="Vasa 10",
    owner=value_list_10,
    breps=flatten(brep_10),
    building_type=hb_building_programs_10,
    electric_demand="E:\DT4PED\DT4PED_Campus\Data\energy_data\Vasa_10_2022.csv")  # -> out, building, area, fractional_hourly_electric_demand, electric_demand_from_program, electric_demand, total_energy_demand, total_installed_capacity; inputs footprints: list of Curve, number_of_floors: list, breps: list, PV_plant: list; same code as building
panel_58 = Panel(building_10.building)
panel_59 = Panel(building_10.electric_demand_from_program)
panel_60 = Panel(building_10.electric_demand)
panel_61 = Panel(building_10.fractional_hourly_electric_demand)

hb_building_programs_11 = HBBuildingPrograms({"LargeOffice", "MediumOffice", "SmallOffice", "MidriseApartment", "HighriseApartment", "Retail", "StripMall", "PrimarySchool", "SecondarySchool", "SmallHotel", "LargeHotel", "Hospital", "Outpatient", "Laboratory", "Warehouse", "SuperMarket", "FullServiceRestaurant", "QuickServiceRestaurant", "Courthouse", "College", "LargeDataCenterHighITE", "LargeDataCenterLowITE", "SmallDataCenterHighITE", "SmallDataCenterLowITE"}, selected="College")
curve_11 = Curve(<curve referenced from the Rhino model>)
panel_62 = Panel("E:\DT4PED\DT4PED_Campus\Data\energy_data\07.27 SB3\electricity_2022.csv")
value_list_11 = ValueList({"Akademiska Hus", "Studentbostäder", "Chalmersfastigheter"}, selected="Studentbostäder")
user_text_11 = UserText(Content=curve_11, Keys="number_of_floors", UserTextMode=1)  # -> Content, Keys, Values
brep_11 = Brep([<brep referenced from the Rhino model> x12])
building_11 = Building(name="SB3", owner=value_list_11, breps=flatten(brep_11), building_type=hb_building_programs_11, electric_demand=panel_62)  # -> out, building, area, fractional_hourly_electric_demand, electric_demand_from_program, electric_demand, total_energy_demand, total_installed_capacity; inputs footprints: list of Curve, number_of_floors: list, breps: list; same code as building
panel_63 = Panel(building_11.building)
panel_64 = Panel(building_11.electric_demand_from_program)
panel_65 = Panel(building_11.electric_demand)
panel_66 = Panel(building_11.fractional_hourly_electric_demand)

hb_building_programs_12 = HBBuildingPrograms({"LargeOffice", "MediumOffice", "SmallOffice", "MidriseApartment", "HighriseApartment", "Retail", "StripMall", "PrimarySchool", "SecondarySchool", "SmallHotel", "LargeHotel", "Hospital", "Outpatient", "Laboratory", "Warehouse", "SuperMarket", "FullServiceRestaurant", "QuickServiceRestaurant", "Courthouse", "College", "LargeDataCenterHighITE", "LargeDataCenterLowITE", "SmallDataCenterHighITE", "SmallDataCenterLowITE"}, selected="College")
curve_12 = Curve(<curve referenced from the Rhino model>)
value_list_12 = ValueList({"Akademiska Hus", "Studentbostäder", "Chalmersfastigheter"}, selected="Studentbostäder")
user_text_12 = UserText(Content=curve_12, Keys="number_of_floors", UserTextMode=1)  # -> Content, Keys, Values
brep_12 = Brep(<brep referenced from the Rhino model>)
building_12 = Building(
    name="Vasa 7",
    owner=value_list_12,
    breps=flatten(brep_12),
    building_type=hb_building_programs_12,
    electric_demand="E:\DT4PED\DT4PED_Campus\Data\energy_data\Vasa_7_2022.csv")  # -> out, building, area, fractional_hourly_electric_demand, electric_demand_from_program, electric_demand, total_energy_demand, total_installed_capacity; inputs footprints: list of Curve, number_of_floors: list, breps: list, PV_plant: list; same code as building
panel_67 = Panel(building_12.building)
panel_68 = Panel(building_12.electric_demand_from_program)
panel_69 = Panel(building_12.electric_demand)
panel_70 = Panel(building_12.fractional_hourly_electric_demand)

hb_building_programs_13 = HBBuildingPrograms({"LargeOffice", "MediumOffice", "SmallOffice", "MidriseApartment", "HighriseApartment", "Retail", "StripMall", "PrimarySchool", "SecondarySchool", "SmallHotel", "LargeHotel", "Hospital", "Outpatient", "Laboratory", "Warehouse", "SuperMarket", "FullServiceRestaurant", "QuickServiceRestaurant", "Courthouse", "College", "LargeDataCenterHighITE", "LargeDataCenterLowITE", "SmallDataCenterHighITE", "SmallDataCenterLowITE"}, selected="College")
curve_13 = Curve(<curve referenced from the Rhino model>)
value_list_13 = ValueList({"Akademiska Hus", "Studentbostäder", "Chalmersfastigheter"}, selected="Studentbostäder")
user_text_13 = UserText(Content=curve_13, Keys="number_of_floors", UserTextMode=1)  # -> Content, Keys, Values
brep_13 = Brep(<brep referenced from the Rhino model>)
building_13 = Building(
    name="Vasa 4",
    owner=value_list_13,
    breps=flatten(brep_13),
    building_type=hb_building_programs_13,
    electric_demand="E:\DT4PED\DT4PED_Campus\Data\energy_data\Vasa_4_2022.csv")  # -> out, building, area, fractional_hourly_electric_demand, electric_demand_from_program, electric_demand, total_energy_demand, total_installed_capacity; inputs footprints: list of Curve, number_of_floors: list, breps: list, PV_plant: list; same code as building
panel_71 = Panel(building_13.building)
panel_72 = Panel(building_13.electric_demand_from_program)
panel_73 = Panel(building_13.electric_demand)
panel_74 = Panel(building_13.fractional_hourly_electric_demand)

hb_building_programs_14 = HBBuildingPrograms({"LargeOffice", "MediumOffice", "SmallOffice", "MidriseApartment", "HighriseApartment", "Retail", "StripMall", "PrimarySchool", "SecondarySchool", "SmallHotel", "LargeHotel", "Hospital", "Outpatient", "Laboratory", "Warehouse", "SuperMarket", "FullServiceRestaurant", "QuickServiceRestaurant", "Courthouse", "College", "LargeDataCenterHighITE", "LargeDataCenterLowITE", "SmallDataCenterHighITE", "SmallDataCenterLowITE"}, selected="College")
curve_14 = Curve(<curve referenced from the Rhino model>)
value_list_14 = ValueList({"Akademiska Hus", "Studentbostäder", "Chalmersfastigheter"}, selected="Studentbostäder")
user_text_14 = UserText(Content=curve_14, Keys="number_of_floors", UserTextMode=1)  # -> Content, Keys, Values
brep_14 = Brep(<brep referenced from the Rhino model>)
building_14 = Building(
    name="Vasa 8",
    owner=value_list_14,
    breps=flatten(brep_14),
    building_type=hb_building_programs_14,
    electric_demand="E:\DT4PED\DT4PED_Campus\Data\energy_data\Vasa_8_2022.csv")  # -> out, building, area, fractional_hourly_electric_demand, electric_demand_from_program, electric_demand, total_energy_demand, total_installed_capacity; inputs footprints: list of Curve, number_of_floors: list, breps: list, PV_plant: list; same code as building
panel_75 = Panel(building_14.building)
panel_76 = Panel(building_14.electric_demand_from_program)
panel_77 = Panel(building_14.electric_demand)
panel_78 = Panel(building_14.fractional_hourly_electric_demand)

hb_building_programs_15 = HBBuildingPrograms({"LargeOffice", "MediumOffice", "SmallOffice", "MidriseApartment", "HighriseApartment", "Retail", "StripMall", "PrimarySchool", "SecondarySchool", "SmallHotel", "LargeHotel", "Hospital", "Outpatient", "Laboratory", "Warehouse", "SuperMarket", "FullServiceRestaurant", "QuickServiceRestaurant", "Courthouse", "College", "LargeDataCenterHighITE", "LargeDataCenterLowITE", "SmallDataCenterHighITE", "SmallDataCenterLowITE"}, selected="College")
curve_15 = Curve(<curve referenced from the Rhino model>)
value_list_15 = ValueList({"Akademiska Hus", "Studentbostäder", "Chalmersfastigheter"}, selected="Studentbostäder")
user_text_15 = UserText(Content=curve_15, Keys="number_of_floors", UserTextMode=1)  # -> Content, Keys, Values
brep_15 = Brep(<brep referenced from the Rhino model>)
building_15 = Building(
    name="Vasa 1",
    owner=value_list_15,
    breps=flatten(brep_15),
    building_type=hb_building_programs_15,
    electric_demand="E:\DT4PED\DT4PED_Campus\Data\energy_data\Vasa_1_2022.csv")  # -> out, building, area, fractional_hourly_electric_demand, electric_demand_from_program, electric_demand, total_energy_demand, total_installed_capacity; inputs footprints: list of Curve, number_of_floors: list, breps: list, PV_plant: list; same code as building
panel_79 = Panel(building_15.building)
panel_80 = Panel(building_15.electric_demand_from_program)
panel_81 = Panel(building_15.electric_demand)
panel_82 = Panel(building_15.fractional_hourly_electric_demand)

hb_building_programs_16 = HBBuildingPrograms({"LargeOffice", "MediumOffice", "SmallOffice", "MidriseApartment", "HighriseApartment", "Retail", "StripMall", "PrimarySchool", "SecondarySchool", "SmallHotel", "LargeHotel", "Hospital", "Outpatient", "Laboratory", "Warehouse", "SuperMarket", "FullServiceRestaurant", "QuickServiceRestaurant", "Courthouse", "College", "LargeDataCenterHighITE", "LargeDataCenterLowITE", "SmallDataCenterHighITE", "SmallDataCenterLowITE"}, selected="College")
curve_16 = Curve(<curve referenced from the Rhino model>)
value_list_16 = ValueList({"Akademiska Hus", "Studentbostäder", "Chalmersfastigheter"}, selected="Studentbostäder")
panel_83 = Panel("E:\DT4PED\DT4PED_Campus\Data\energy_data\Teknikparken_2022.csv")
user_text_16 = UserText(Content=curve_16, Keys="number_of_floors", UserTextMode=1)  # -> Content, Keys, Values
brep_16 = Brep(<brep referenced from the Rhino model>)
building_16 = Building(
    name="Teknikparken",
    owner=value_list_16,
    breps=flatten(brep_16),
    building_type=hb_building_programs_16,
    electric_demand=panel_83)  # -> out, building, area, fractional_hourly_electric_demand, electric_demand_from_program, electric_demand, total_energy_demand, total_installed_capacity; inputs footprints: list of Curve, number_of_floors: list, breps: list, PV_plant: list; same code as building
panel_84 = Panel(building_16.building)
panel_85 = Panel(building_16.electric_demand_from_program)
panel_86 = Panel(building_16.electric_demand)
panel_87 = Panel(building_16.fractional_hourly_electric_demand)

hb_building_programs_17 = HBBuildingPrograms({"LargeOffice", "MediumOffice", "SmallOffice", "MidriseApartment", "HighriseApartment", "Retail", "StripMall", "PrimarySchool", "SecondarySchool", "SmallHotel", "LargeHotel", "Hospital", "Outpatient", "Laboratory", "Warehouse", "SuperMarket", "FullServiceRestaurant", "QuickServiceRestaurant", "Courthouse", "College", "LargeDataCenterHighITE", "LargeDataCenterLowITE", "SmallDataCenterHighITE", "SmallDataCenterLowITE"}, selected="College")
curve_17 = Curve(<curve referenced from the Rhino model>)
value_list_17 = ValueList({"Akademiska Hus", "Studentbostäder", "Chalmersfastigheter"}, selected="Studentbostäder")
user_text_17 = UserText(Content=curve_17, Keys="number_of_floors", UserTextMode=1)  # -> Content, Keys, Values
brep_17 = Brep(<brep referenced from the Rhino model>)
building_17 = Building(
    name="MC2",
    owner=value_list_17,
    breps=flatten(brep_17),
    building_type=hb_building_programs_17,
    electric_demand="E:\DT4PED\DT4PED_Campus\Data\energy_data\MC2_2022.csv")  # -> out, building, area, fractional_hourly_electric_demand, electric_demand_from_program, electric_demand, total_energy_demand, total_installed_capacity; inputs footprints: list of Curve, number_of_floors: list, breps: list, PV_plant: list; same code as building
panel_88 = Panel(building_17.building)
panel_89 = Panel(building_17.electric_demand_from_program)
panel_90 = Panel(building_17.electric_demand)
panel_91 = Panel(building_17.fractional_hourly_electric_demand)

hb_building_programs_18 = HBBuildingPrograms({"LargeOffice", "MediumOffice", "SmallOffice", "MidriseApartment", "HighriseApartment", "Retail", "StripMall", "PrimarySchool", "SecondarySchool", "SmallHotel", "LargeHotel", "Hospital", "Outpatient", "Laboratory", "Warehouse", "SuperMarket", "FullServiceRestaurant", "QuickServiceRestaurant", "Courthouse", "College", "LargeDataCenterHighITE", "LargeDataCenterLowITE", "SmallDataCenterHighITE", "SmallDataCenterLowITE"}, selected="College")
curve_18 = Curve(<curve referenced from the Rhino model>)
value_list_18 = ValueList({"Akademiska Hus", "Studentbostäder", "Chalmersfastigheter"}, selected="Studentbostäder")
panel_92 = Panel("E:\DT4PED\DT4PED_Campus\Data\energy_data\Nya_Matte_2022.csv")
user_text_18 = UserText(Content=curve_18, Keys="number_of_floors", UserTextMode=1)  # -> Content, Keys, Values
brep_18 = Brep(<brep referenced from the Rhino model>)
building_18 = Building(
    name="Nya Matte",
    owner=value_list_18,
    breps=flatten(brep_18),
    building_type=hb_building_programs_18,
    electric_demand=panel_92)  # -> out, building, area, fractional_hourly_electric_demand, electric_demand_from_program, electric_demand, total_energy_demand, total_installed_capacity; inputs footprints: list of Curve, number_of_floors: list, breps: list, PV_plant: list; same code as building
panel_93 = Panel(building_18.building)
panel_94 = Panel(building_18.electric_demand_from_program)
panel_95 = Panel(building_18.electric_demand)
panel_96 = Panel(building_18.fractional_hourly_electric_demand)

hb_building_programs_19 = HBBuildingPrograms({"LargeOffice", "MediumOffice", "SmallOffice", "MidriseApartment", "HighriseApartment", "Retail", "StripMall", "PrimarySchool", "SecondarySchool", "SmallHotel", "LargeHotel", "Hospital", "Outpatient", "Laboratory", "Warehouse", "SuperMarket", "FullServiceRestaurant", "QuickServiceRestaurant", "Courthouse", "College", "LargeDataCenterHighITE", "LargeDataCenterLowITE", "SmallDataCenterHighITE", "SmallDataCenterLowITE"}, selected="College")
curve_19 = Curve(<curve referenced from the Rhino model>)
value_list_19 = ValueList({"Akademiska Hus", "Studentbostäder", "Chalmersfastigheter"}, selected="Studentbostäder")
panel_97 = Panel("E:\DT4PED\DT4PED_Campus\Data\energy_data\Reaktorfysik_2022.csv")
user_text_19 = UserText(Content=curve_19, Keys="number_of_floors", UserTextMode=1)  # -> Content, Keys, Values
brep_19 = Brep(<brep referenced from the Rhino model>)
building_19 = Building(
    name="Reaktorfysik",
    owner=value_list_19,
    breps=flatten(brep_19),
    building_type=hb_building_programs_19,
    electric_demand=panel_97)  # -> out, building, area, fractional_hourly_electric_demand, electric_demand_from_program, electric_demand, total_energy_demand, total_installed_capacity; inputs footprints: list of Curve, number_of_floors: list, breps: list, PV_plant: list; same code as building
panel_98 = Panel(building_19.building)
panel_99 = Panel(building_19.electric_demand_from_program)
panel_100 = Panel(building_19.electric_demand)
panel_101 = Panel(building_19.fractional_hourly_electric_demand)

hb_building_programs_20 = HBBuildingPrograms({"LargeOffice", "MediumOffice", "SmallOffice", "MidriseApartment", "HighriseApartment", "Retail", "StripMall", "PrimarySchool", "SecondarySchool", "SmallHotel", "LargeHotel", "Hospital", "Outpatient", "Laboratory", "Warehouse", "SuperMarket", "FullServiceRestaurant", "QuickServiceRestaurant", "Courthouse", "College", "LargeDataCenterHighITE", "LargeDataCenterLowITE", "SmallDataCenterHighITE", "SmallDataCenterLowITE"}, selected="College")
curve_20 = Curve(<curve referenced from the Rhino model>)
value_list_20 = ValueList({"Akademiska Hus", "Studentbostäder", "Chalmersfastigheter"}, selected="Studentbostäder")
panel_102 = Panel("E:\DT4PED\DT4PED_Campus\Data\energy_data\Kårresturangen_2022.csv")
user_text_20 = UserText(Content=curve_20, Keys="number_of_floors", UserTextMode=1)  # -> Content, Keys, Values
brep_20 = Brep(<brep referenced from the Rhino model>)
building_20 = Building(
    name="Kårresturangen",
    owner=value_list_20,
    breps=flatten(brep_20),
    building_type=hb_building_programs_20,
    electric_demand=panel_102)  # -> out, building, area, fractional_hourly_electric_demand, electric_demand_from_program, electric_demand, total_energy_demand, total_installed_capacity; inputs footprints: list of Curve, number_of_floors: list, breps: list, PV_plant: list; same code as building
panel_103 = Panel(building_20.building)
panel_104 = Panel(building_20.electric_demand_from_program)
panel_105 = Panel(building_20.electric_demand)
panel_106 = Panel(building_20.fractional_hourly_electric_demand)

hb_building_programs_21 = HBBuildingPrograms({"LargeOffice", "MediumOffice", "SmallOffice", "MidriseApartment", "HighriseApartment", "Retail", "StripMall", "PrimarySchool", "SecondarySchool", "SmallHotel", "LargeHotel", "Hospital", "Outpatient", "Laboratory", "Warehouse", "SuperMarket", "FullServiceRestaurant", "QuickServiceRestaurant", "Courthouse", "College", "LargeDataCenterHighITE", "LargeDataCenterLowITE", "SmallDataCenterHighITE", "SmallDataCenterLowITE"}, selected="College")
curve_21 = Curve(<curve referenced from the Rhino model>)
value_list_21 = ValueList({"Akademiska Hus", "Studentbostäder", "Chalmersfastigheter"}, selected="Studentbostäder")
panel_107 = Panel("E:\DT4PED\DT4PED_Campus\Data\energy_data\07.24 Edit\electricity_2022.csv")
user_text_21 = UserText(Content=curve_21, Keys="number_of_floors", UserTextMode=1)  # -> Content, Keys, Values
brep_21 = Brep(<brep referenced from the Rhino model>)
building_21 = Building(
    name="Edit",
    owner=value_list_21,
    breps=flatten(brep_21),
    building_type=hb_building_programs_21,
    electric_demand=panel_107,
    PV_plant=pvplant_5.PV_plant)  # -> out, building, area, fractional_hourly_electric_demand, electric_demand_from_program, electric_demand, total_energy_demand, total_installed_capacity; inputs footprints: list of Curve, number_of_floors: list, breps: list, PV_plant: list; same code as building
panel_108 = Panel(building_21.building)
panel_109 = Panel(building_21.electric_demand_from_program)
panel_110 = Panel(building_21.electric_demand)
panel_111 = Panel(building_21.fractional_hourly_electric_demand)

hb_building_programs_22 = HBBuildingPrograms({"LargeOffice", "MediumOffice", "SmallOffice", "MidriseApartment", "HighriseApartment", "Retail", "StripMall", "PrimarySchool", "SecondarySchool", "SmallHotel", "LargeHotel", "Hospital", "Outpatient", "Laboratory", "Warehouse", "SuperMarket", "FullServiceRestaurant", "QuickServiceRestaurant", "Courthouse", "College", "LargeDataCenterHighITE", "LargeDataCenterLowITE", "SmallDataCenterHighITE", "SmallDataCenterLowITE"}, selected="College")
curve_22 = Curve(<curve referenced from the Rhino model>)
panel_112 = Panel("E:\DT4PED\DT4PED_Campus\Data\energy_data\07.25 HB\electricity_2022.csv")
value_list_22 = ValueList({"Akademiska Hus", "Studentbostäder", "Chalmersfastigheter"}, selected="Studentbostäder")
user_text_22 = UserText(Content=curve_22, Keys="number_of_floors", UserTextMode=1)  # -> Content, Keys, Values
brep_22 = Brep(<brep referenced from the Rhino model>)
building_22 = Building(name="HB", owner=value_list_22, breps=flatten(brep_22), building_type=hb_building_programs_22, electric_demand=panel_112)  # -> out, building, area, fractional_hourly_electric_demand, electric_demand_from_program, electric_demand, total_energy_demand, total_installed_capacity; inputs footprints: list of Curve, number_of_floors: list, breps: list; same code as building
panel_113 = Panel(building_22.building)
panel_114 = Panel(building_22.electric_demand_from_program)
panel_115 = Panel(building_22.electric_demand)
panel_116 = Panel(building_22.fractional_hourly_electric_demand)

hb_building_programs_23 = HBBuildingPrograms({"LargeOffice", "MediumOffice", "SmallOffice", "MidriseApartment", "HighriseApartment", "Retail", "StripMall", "PrimarySchool", "SecondarySchool", "SmallHotel", "LargeHotel", "Hospital", "Outpatient", "Laboratory", "Warehouse", "SuperMarket", "FullServiceRestaurant", "QuickServiceRestaurant", "Courthouse", "College", "LargeDataCenterHighITE", "LargeDataCenterLowITE", "SmallDataCenterHighITE", "SmallDataCenterLowITE"}, selected="College")
curve_23 = Curve(<curve referenced from the Rhino model>)
value_list_23 = ValueList({"Akademiska Hus", "Studentbostäder", "Chalmersfastigheter"}, selected="Studentbostäder")
panel_117 = Panel("E:\DT4PED\DT4PED_Campus\Data\energy_data\Kårhus_entré_2022.csv")
user_text_23 = UserText(Content=curve_23, Keys="number_of_floors", UserTextMode=1)  # -> Content, Keys, Values
brep_23 = Brep(<brep referenced from the Rhino model>)
building_23 = Building(
    name="Kårhus entré",
    owner=value_list_23,
    breps=flatten(brep_23),
    building_type=hb_building_programs_23,
    electric_demand=panel_117)  # -> out, building, area, fractional_hourly_electric_demand, electric_demand_from_program, electric_demand, total_energy_demand, total_installed_capacity; inputs footprints: list of Curve, number_of_floors: list, breps: list, PV_plant: list; same code as building
panel_118 = Panel(building_23.building)
panel_119 = Panel(building_23.electric_demand_from_program)
panel_120 = Panel(building_23.electric_demand)
panel_121 = Panel(building_23.fractional_hourly_electric_demand)

hb_building_programs_24 = HBBuildingPrograms({"LargeOffice", "MediumOffice", "SmallOffice", "MidriseApartment", "HighriseApartment", "Retail", "StripMall", "PrimarySchool", "SecondarySchool", "SmallHotel", "LargeHotel", "Hospital", "Outpatient", "Laboratory", "Warehouse", "SuperMarket", "FullServiceRestaurant", "QuickServiceRestaurant", "Courthouse", "College", "LargeDataCenterHighITE", "LargeDataCenterLowITE", "SmallDataCenterHighITE", "SmallDataCenterLowITE"}, selected="College")
curve_24 = Curve(<curve referenced from the Rhino model>)
value_list_24 = ValueList({"Akademiska Hus", "Studentbostäder", "Chalmersfastigheter"}, selected="Studentbostäder")
user_text_24 = UserText(Content=curve_24, Keys="number_of_floors", UserTextMode=1)  # -> Content, Keys, Values
brep_24 = Brep(<brep referenced from the Rhino model>)
building_24 = Building(
    name="JSP",
    owner=value_list_24,
    breps=flatten(brep_24),
    building_type=hb_building_programs_24,
    electric_demand="E:\DT4PED\DT4PED_Campus\Data\energy_data\JSP_2022.csv")  # -> out, building, area, fractional_hourly_electric_demand, electric_demand_from_program, electric_demand, total_energy_demand, total_installed_capacity; inputs footprints: list of Curve, number_of_floors: list, breps: list, PV_plant: list; same code as building
panel_122 = Panel(building_24.building)
panel_123 = Panel(building_24.electric_demand_from_program)
panel_124 = Panel(building_24.electric_demand)
panel_125 = Panel(building_24.fractional_hourly_electric_demand)

hb_building_programs_25 = HBBuildingPrograms({"LargeOffice", "MediumOffice", "SmallOffice", "MidriseApartment", "HighriseApartment", "Retail", "StripMall", "PrimarySchool", "SecondarySchool", "SmallHotel", "LargeHotel", "Hospital", "Outpatient", "Laboratory", "Warehouse", "SuperMarket", "FullServiceRestaurant", "QuickServiceRestaurant", "Courthouse", "College", "LargeDataCenterHighITE", "LargeDataCenterLowITE", "SmallDataCenterHighITE", "SmallDataCenterLowITE"}, selected="LargeOffice")
panel_126 = Panel("E:\DT4PED\DT4PED_Campus\Data\energy_data\07.888 Lokalkontor\electricity_2022.csv")
curve_25 = Curve(<curve referenced from the Rhino model>)
value_list_25 = ValueList({"Akademiska Hus", "Studentbostäder", "Chalmersfastigheter"}, selected="Studentbostäder")
user_text_25 = UserText(Content=curve_25, Keys="number_of_floors", UserTextMode=1)  # -> Content, Keys, Values
brep_25 = Brep([<brep referenced from the Rhino model> x6])
building_25 = Building(
    name="Lokalkontor",
    owner=value_list_25,
    breps=flatten(brep_25),
    building_type=hb_building_programs_25,
    electric_demand=panel_126)  # -> out, building, area, fractional_hourly_electric_demand, electric_demand_from_program, electric_demand, total_energy_demand, total_installed_capacity; inputs footprints: list of Curve, number_of_floors: list, breps: list; same code as building
panel_127 = Panel(building_25.building)
panel_128 = Panel(building_25.electric_demand_from_program)
panel_129 = Panel(building_25.electric_demand)
panel_130 = Panel(building_25.fractional_hourly_electric_demand)

hb_building_programs_26 = HBBuildingPrograms({"LargeOffice", "MediumOffice", "SmallOffice", "MidriseApartment", "HighriseApartment", "Retail", "StripMall", "PrimarySchool", "SecondarySchool", "SmallHotel", "LargeHotel", "Hospital", "Outpatient", "Laboratory", "Warehouse", "SuperMarket", "FullServiceRestaurant", "QuickServiceRestaurant", "Courthouse", "College", "LargeDataCenterHighITE", "LargeDataCenterLowITE", "SmallDataCenterHighITE", "SmallDataCenterLowITE"}, selected="College")
curve_26 = Curve(<curve referenced from the Rhino model>)
value_list_26 = ValueList({"Akademiska Hus", "Studentbostäder", "Chalmersfastigheter"}, selected="Studentbostäder")
panel_131 = Panel("E:\DT4PED\DT4PED_Campus\Data\energy_data\Emils_kårhus_2022.csv")
user_text_26 = UserText(Content=curve_26, Keys="number_of_floors", UserTextMode=1)  # -> Content, Keys, Values
brep_26 = Brep(<brep referenced from the Rhino model>)
building_26 = Building(
    name="Emils kårhus",
    owner=value_list_26,
    breps=flatten(brep_26),
    building_type=hb_building_programs_26,
    electric_demand=panel_131)  # -> out, building, area, fractional_hourly_electric_demand, electric_demand_from_program, electric_demand, total_energy_demand, total_installed_capacity; inputs footprints: list of Curve, number_of_floors: list, breps: list, PV_plant: list; same code as building
panel_132 = Panel(building_26.building)
panel_133 = Panel(building_26.electric_demand_from_program)
panel_134 = Panel(building_26.electric_demand)
panel_135 = Panel(building_26.fractional_hourly_electric_demand)

hb_building_programs_27 = HBBuildingPrograms({"LargeOffice", "MediumOffice", "SmallOffice", "MidriseApartment", "HighriseApartment", "Retail", "StripMall", "PrimarySchool", "SecondarySchool", "SmallHotel", "LargeHotel", "Hospital", "Outpatient", "Laboratory", "Warehouse", "SuperMarket", "FullServiceRestaurant", "QuickServiceRestaurant", "Courthouse", "College", "LargeDataCenterHighITE", "LargeDataCenterLowITE", "SmallDataCenterHighITE", "SmallDataCenterLowITE"}, selected="College")
panel_136 = Panel("E:\DT4PED\DT4PED_Campus\Data\energy_data\07.40 Gamla matte\electricity_2022.csv")
value_list_27 = ValueList({"Akademiska Hus", "Studentbostäder", "Chalmersfastigheter"}, selected="Chalmersfastigheter")
curve_27 = Curve(<curve referenced from the Rhino model>)
user_text_27 = UserText(Content=curve_27, Keys="number_of_floors", UserTextMode=1)  # -> Content, Keys, Values
brep_27 = Brep([<brep referenced from the Rhino model> x4])
building_27 = Building(
    name="Gamla matte",
    owner=value_list_27,
    breps=flatten(brep_27),
    building_type=hb_building_programs_27,
    electric_demand=panel_136)  # -> out, building, area, fractional_hourly_electric_demand, electric_demand_from_program, electric_demand, total_energy_demand, total_installed_capacity; inputs footprints: list of Curve, number_of_floors: list, breps: list; same code as building
panel_137 = Panel(building_27.building)
panel_138 = Panel(building_27.electric_demand_from_program)
panel_139 = Panel(building_27.electric_demand)
panel_140 = Panel(building_27.fractional_hourly_electric_demand)

hb_building_programs_28 = HBBuildingPrograms({"LargeOffice", "MediumOffice", "SmallOffice", "MidriseApartment", "HighriseApartment", "Retail", "StripMall", "PrimarySchool", "SecondarySchool", "SmallHotel", "LargeHotel", "Hospital", "Outpatient", "Laboratory", "Warehouse", "SuperMarket", "FullServiceRestaurant", "QuickServiceRestaurant", "Courthouse", "College", "LargeDataCenterHighITE", "LargeDataCenterLowITE", "SmallDataCenterHighITE", "SmallDataCenterLowITE"}, selected="College")
panel_141 = Panel("E:\DT4PED\DT4PED_Campus\Data\energy_data\07.23 SB2\electricity_2022.csv")
value_list_28 = ValueList({"Akademiska Hus", "Studentbostäder", "Chalmersfastigheter"}, selected="Studentbostäder")
brep_28 = Brep([<brep referenced from the Rhino model> x8])
building_28 = Building(
    name="SB2",
    owner=value_list_28,
    breps=flatten(brep_28),
    building_type=hb_building_programs_28,
    electric_demand=panel_141,
    PV_plant=pvplant_4.PV_plant)  # -> out, building, area, fractional_hourly_electric_demand, electric_demand_from_program, electric_demand, total_energy_demand, total_installed_capacity; inputs footprints: list of Curve, number_of_floors: list, breps: list, PV_plant: list; same code as building
panel_142 = Panel(building_28.building)

curve_28 = Curve([<curve referenced from the Rhino model> x7])

hb_building_programs_29 = HBBuildingPrograms({"LargeOffice", "MediumOffice", "SmallOffice", "MidriseApartment", "HighriseApartment", "Retail", "StripMall", "PrimarySchool", "SecondarySchool", "SmallHotel", "LargeHotel", "Hospital", "Outpatient", "Laboratory", "Warehouse", "SuperMarket", "FullServiceRestaurant", "QuickServiceRestaurant", "Courthouse", "College", "LargeDataCenterHighITE", "LargeDataCenterLowITE", "SmallDataCenterHighITE", "SmallDataCenterLowITE"}, selected="College")
curve_29 = Curve(<curve referenced from the Rhino model>)
value_list_29 = ValueList({"Akademiska Hus", "Studentbostäder", "Chalmersfastigheter"}, selected="Chalmersfastigheter")
user_text_28 = UserText(Content=curve_29, Keys="number_of_floors", UserTextMode=1)  # -> Content, Keys, Values
brep_29 = Brep(<brep referenced from the Rhino model>)
building_29 = Building(
    name="Bibliotek",
    owner=value_list_29,
    footprints=flatten(curve_28),
    number_of_floors=flatten(Slider(3, range=0..10)),
    building_type=hb_building_programs_29,
    electric_demand="E:\DT4PED\DT4PED_Campus\Data\energy_data\Vasa_15_2022.csv",
    PV_plant=pvplant_3.PV_plant)  # -> out, building, area, fractional_hourly_electric_demand, electric_demand_from_program, electric_demand, total_energy_demand, total_installed_capacity; inputs footprints: list of Curve, number_of_floors: list, breps: list, PV_plant: list; same code as building
panel_143 = Panel(building_29.building)
panel_144 = Panel(building_29.electric_demand_from_program)
panel_145 = Panel(building_29.electric_demand)
panel_146 = Panel(building_29.fractional_hourly_electric_demand)

hb_building_programs_30 = HBBuildingPrograms({"LargeOffice", "MediumOffice", "SmallOffice", "MidriseApartment", "HighriseApartment", "Retail", "StripMall", "PrimarySchool", "SecondarySchool", "SmallHotel", "LargeHotel", "Hospital", "Outpatient", "Laboratory", "Warehouse", "SuperMarket", "FullServiceRestaurant", "QuickServiceRestaurant", "Courthouse", "College", "LargeDataCenterHighITE", "LargeDataCenterLowITE", "SmallDataCenterHighITE", "SmallDataCenterLowITE"}, selected="College")
curve_30 = Curve(<curve referenced from the Rhino model>)
panel_147 = Panel("E:\DT4PED\DT4PED_Campus\Data\energy_data\07.22 HA\electricity_2022.csv")
value_list_30 = ValueList({"Akademiska Hus", "Studentbostäder", "Chalmersfastigheter"}, selected="Studentbostäder")
user_text_29 = UserText(Content=curve_30, Keys="number_of_floors", UserTextMode=1)  # -> Content, Keys, Values
brep_30 = Brep(<brep referenced from the Rhino model>)
building_30 = Building(name="HA", owner=value_list_30, breps=flatten(brep_30), building_type=hb_building_programs_30, electric_demand=panel_147)  # -> out, flatten(building), area, fractional_hourly_electric_demand, electric_demand_from_program, electric_demand, total_energy_demand, total_installed_capacity; inputs footprints: list of Curve, number_of_floors: list, breps: list; same code as building
panel_148 = Panel(building_30.building)
panel_149 = Panel(building_30.electric_demand_from_program)
panel_150 = Panel(building_30.electric_demand)
panel_151 = Panel(building_30.fractional_hourly_electric_demand)

hb_building_programs_31 = HBBuildingPrograms({"LargeOffice", "MediumOffice", "SmallOffice", "MidriseApartment", "HighriseApartment", "Retail", "StripMall", "PrimarySchool", "SecondarySchool", "SmallHotel", "LargeHotel", "Hospital", "Outpatient", "Laboratory", "Warehouse", "SuperMarket", "FullServiceRestaurant", "QuickServiceRestaurant", "Courthouse", "College", "LargeDataCenterHighITE", "LargeDataCenterLowITE", "SmallDataCenterHighITE", "SmallDataCenterLowITE"}, selected="LargeOffice")
curve_31 = Curve(<curve referenced from the Rhino model>)
panel_152 = Panel("E:\DT4PED\DT4PED_Campus\Data\energy_data\CSB_Chabo_2022.csv")
value_list_31 = ValueList({"Akademiska Hus", "Studentbostäder", "Chalmersfastigheter"}, selected="Studentbostäder")
user_text_30 = UserText(Content=curve_31, Keys="number_of_floors", UserTextMode=1)  # -> Content, Keys, Values
brep_31 = Brep(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)
building_31 = Building(
    name="CSB Chabo",
    owner=value_list_31,
    breps=flatten(brep_31),
    building_type=hb_building_programs_31,
    electric_demand=panel_152)  # -> out, building, area, fractional_hourly_electric_demand, electric_demand_from_program, electric_demand, total_energy_demand, total_installed_capacity; inputs footprints: list of Curve, number_of_floors: list, breps: list; same code as building
panel_153 = Panel(building_31.building)
panel_154 = Panel(building_31.electric_demand_from_program)
panel_155 = Panel(building_31.electric_demand)
panel_156 = Panel(building_31.fractional_hourly_electric_demand)

hb_building_programs_32 = HBBuildingPrograms({"LargeOffice", "MediumOffice", "SmallOffice", "MidriseApartment", "HighriseApartment", "Retail", "StripMall", "PrimarySchool", "SecondarySchool", "SmallHotel", "LargeHotel", "Hospital", "Outpatient", "Laboratory", "Warehouse", "SuperMarket", "FullServiceRestaurant", "QuickServiceRestaurant", "Courthouse", "College", "LargeDataCenterHighITE", "LargeDataCenterLowITE", "SmallDataCenterHighITE", "SmallDataCenterLowITE"}, selected="LargeOffice")
curve_32 = Curve(<curve referenced from the Rhino model>)
panel_157 = Panel("E:\DT4PED\DT4PED_Campus\Data\energy_data\CSB_Gibraltarvallen_guesthouse_2022.csv")
value_list_32 = ValueList({"Akademiska Hus", "Studentbostäder", "Chalmersfastigheter"}, selected="Studentbostäder")
user_text_31 = UserText(Content=curve_32, Keys="number_of_floors", UserTextMode=1)  # -> Content, Keys, Values
brep_32 = Brep(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)
building_32 = Building(
    name="CSB Gibraltarvallen guesthouse",
    owner=value_list_32,
    breps=flatten(brep_32),
    building_type=hb_building_programs_32,
    electric_demand=panel_157)  # -> out, building, area, fractional_hourly_electric_demand, electric_demand_from_program, electric_demand, total_energy_demand, total_installed_capacity; inputs footprints: list of Curve, number_of_floors: list, breps: list; same code as building
panel_158 = Panel(building_32.building)
panel_159 = Panel(building_32.electric_demand_from_program)
panel_160 = Panel(building_32.electric_demand)
panel_161 = Panel(building_32.fractional_hourly_electric_demand)

hb_building_programs_33 = HBBuildingPrograms({"LargeOffice", "MediumOffice", "SmallOffice", "MidriseApartment", "HighriseApartment", "Retail", "StripMall", "PrimarySchool", "SecondarySchool", "SmallHotel", "LargeHotel", "Hospital", "Outpatient", "Laboratory", "Warehouse", "SuperMarket", "FullServiceRestaurant", "QuickServiceRestaurant", "Courthouse", "College", "LargeDataCenterHighITE", "LargeDataCenterLowITE", "SmallDataCenterHighITE", "SmallDataCenterLowITE"}, selected="LargeOffice")
curve_33 = Curve(<curve referenced from the Rhino model>)
panel_162 = Panel("E:\DT4PED\DT4PED_Campus\Data\energy_data\CSB_Holtermansgatan_2022.csv")
value_list_33 = ValueList({"Akademiska Hus", "Studentbostäder", "Chalmersfastigheter"}, selected="Studentbostäder")
user_text_32 = UserText(Content=curve_33, Keys="number_of_floors", UserTextMode=1)  # -> Content, Keys, Values
brep_33 = Brep(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)
building_33 = Building(
    name="CSB Holtermansgatan",
    owner=value_list_33,
    breps=flatten(brep_33),
    building_type=hb_building_programs_33,
    electric_demand=panel_162)  # -> out, building, area, fractional_hourly_electric_demand, electric_demand_from_program, electric_demand, total_energy_demand, total_installed_capacity; inputs footprints: list of Curve, number_of_floors: list, breps: list; same code as building
panel_163 = Panel(building_33.building)
panel_164 = Panel(building_33.electric_demand_from_program)
panel_165 = Panel(building_33.electric_demand)
panel_166 = Panel(building_33.fractional_hourly_electric_demand)

hb_building_programs_34 = HBBuildingPrograms({"LargeOffice", "MediumOffice", "SmallOffice", "MidriseApartment", "HighriseApartment", "Retail", "StripMall", "PrimarySchool", "SecondarySchool", "SmallHotel", "LargeHotel", "Hospital", "Outpatient", "Laboratory", "Warehouse", "SuperMarket", "FullServiceRestaurant", "QuickServiceRestaurant", "Courthouse", "College", "LargeDataCenterHighITE", "LargeDataCenterLowITE", "SmallDataCenterHighITE", "SmallDataCenterLowITE"}, selected="LargeOffice")
curve_34 = Curve(<curve referenced from the Rhino model>)
value_list_34 = ValueList({"Akademiska Hus", "Studentbostäder", "Chalmersfastigheter"}, selected="Studentbostäder")
user_text_33 = UserText(Content=curve_34, Keys="number_of_floors", UserTextMode=1)  # -> Content, Keys, Values
brep_34 = Brep(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)
building_34 = Building(
    name="CA-Huset",
    owner=value_list_34,
    breps=flatten(brep_34),
    building_type=hb_building_programs_34,
    electric_demand="E:\DT4PED\DT4PED_Campus\Data\energy_data\CA-Huset_2022.csv")  # -> out, building, area, fractional_hourly_electric_demand, electric_demand_from_program, electric_demand, total_energy_demand, total_installed_capacity; inputs footprints: list of Curve, number_of_floors: list, breps: list; same code as building
panel_167 = Panel(building_34.building)
panel_168 = Panel(building_34.electric_demand_from_program)
panel_169 = Panel(building_34.electric_demand)
panel_170 = Panel(building_34.fractional_hourly_electric_demand)

curve_35 = Curve(<curve referenced from the Rhino model>)

hb_building_programs_35 = HBBuildingPrograms({"LargeOffice", "MediumOffice", "SmallOffice", "MidriseApartment", "HighriseApartment", "Retail", "StripMall", "PrimarySchool", "SecondarySchool", "SmallHotel", "LargeHotel", "Hospital", "Outpatient", "Laboratory", "Warehouse", "SuperMarket", "FullServiceRestaurant", "QuickServiceRestaurant", "Courthouse", "College", "LargeDataCenterHighITE", "LargeDataCenterLowITE", "SmallDataCenterHighITE", "SmallDataCenterLowITE"}, selected="MediumOffice")
curve_36 = Curve(<curve referenced from the Rhino model>)
value_list_35 = ValueList({"Akademiska Hus", "Studentbostäder", "Chalmersfastigheter"}, selected="Akademiska Hus")
user_text_34 = UserText(Content=curve_36, Keys="number_of_floors", UserTextMode=1)  # -> Content, Keys, Values
brep_35 = Brep(<brep referenced from the Rhino model>)
building_35 = Building(
    name="AWL",
    owner=value_list_35,
    footprints=flatten(curve_35),
    number_of_floors=flatten(Slider(7, range=0..10)),
    building_type=hb_building_programs_35,
    electric_demand="E:\DT4PED\DT4PED_Campus\Data\energy_data\Vasa_15_2022.csv",
    PV_plant=pvplant.PV_plant)  # -> out, building, area, fractional_hourly_electric_demand, electric_demand_from_program, electric_demand, total_energy_demand, total_installed_capacity; inputs footprints: list of Curve, number_of_floors: list, breps: list, PV_plant: list; same code as building
panel_171 = Panel(building_35.building)
panel_172 = Panel(building_35.electric_demand_from_program)
panel_173 = Panel(building_35.electric_demand)
panel_174 = Panel(building_35.fractional_hourly_electric_demand)

curve_37 = Curve(<curve referenced from the Rhino model>)

curve_38 = Curve(<curve referenced from the Rhino model>)
hb_building_programs_36 = HBBuildingPrograms({"LargeOffice", "MediumOffice", "SmallOffice", "MidriseApartment", "HighriseApartment", "Retail", "StripMall", "PrimarySchool", "SecondarySchool", "SmallHotel", "LargeHotel", "Hospital", "Outpatient", "Laboratory", "Warehouse", "SuperMarket", "FullServiceRestaurant", "QuickServiceRestaurant", "Courthouse", "College", "LargeDataCenterHighITE", "LargeDataCenterLowITE", "SmallDataCenterHighITE", "SmallDataCenterLowITE"}, selected="College")
panel_175 = Panel("E:\DT4PED\DT4PED_Campus\Data\energy_data\07.18 Idelära\electricity_2022.csv")
user_text_35 = UserText(Content=curve_38, Keys="number_of_floors", UserTextMode=1)  # -> Content, Keys, Values
value_list_36 = ValueList({"Akademiska Hus", "Studentbostäder", "Chalmersfastigheter"}, selected="Studentbostäder")
brep_36 = Brep(<brep referenced from the Rhino model>)  # disabled
building_36 = Building(
    name="Idélära",
    owner=value_list_36,
    footprints=flatten(curve_37),
    number_of_floors=flatten(Slider(2, range=0..10)),
    building_type=hb_building_programs_36,
    electric_demand=panel_175)  # -> out, building, area, fractional_hourly_electric_demand, electric_demand_from_program, electric_demand, total_energy_demand, total_installed_capacity; inputs footprints: list of Curve, number_of_floors: list, breps: list; same code as building
panel_176 = Panel(building_36.building)
panel_177 = Panel(building_36.electric_demand)
panel_178 = Panel(building_36.electric_demand_from_program)
panel_179 = Panel(building_36.fractional_hourly_electric_demand)

brep_37 = Brep([<brep referenced from the Rhino model> x14])

hb_building_programs_37 = HBBuildingPrograms({"LargeOffice", "MediumOffice", "SmallOffice", "MidriseApartment", "HighriseApartment", "Retail", "StripMall", "PrimarySchool", "SecondarySchool", "SmallHotel", "LargeHotel", "Hospital", "Outpatient", "Laboratory", "Warehouse", "SuperMarket", "FullServiceRestaurant", "QuickServiceRestaurant", "Courthouse", "College", "LargeDataCenterHighITE", "LargeDataCenterLowITE", "SmallDataCenterHighITE", "SmallDataCenterLowITE"}, selected="College")
panel_180 = Panel("E:\DT4PED\DT4PED_Campus\Data\energy_data\07.28 Maskinteknik\electricity_2022.csv")
curve_39 = Curve(<curve referenced from the Rhino model>)
value_list_37 = ValueList({"Akademiska Hus", "Studentbostäder", "Chalmersfastigheter"}, selected="Akademiska Hus")
user_text_36 = UserText(Content=curve_39, Keys="number_of_floors", UserTextMode=1)  # -> Content, Keys, Values
building_37 = Building(
    name="Maskinteknik",
    owner=value_list_37,
    breps=flatten(brep_37),
    building_type=hb_building_programs_37,
    electric_demand=panel_180)  # -> out, building, area, fractional_hourly_electric_demand, electric_demand_from_program, electric_demand, total_energy_demand, total_installed_capacity; inputs footprints: list of Curve, number_of_floors: list, breps: list; same code as building
panel_181 = Panel(building_37.building)
panel_182 = Panel(building_37.electric_demand_from_program)
panel_183 = Panel(building_37.electric_demand)
panel_184 = Panel(building_37.fractional_hourly_electric_demand)

curve_40 = Curve(<curve referenced from the Rhino model>)

hb_building_programs_38 = HBBuildingPrograms({"LargeOffice", "MediumOffice", "SmallOffice", "MidriseApartment", "HighriseApartment", "Retail", "StripMall", "PrimarySchool", "SecondarySchool", "SmallHotel", "LargeHotel", "Hospital", "Outpatient", "Laboratory", "Warehouse", "SuperMarket", "FullServiceRestaurant", "QuickServiceRestaurant", "Courthouse", "College", "LargeDataCenterHighITE", "LargeDataCenterLowITE", "SmallDataCenterHighITE", "SmallDataCenterLowITE"}, selected="MidriseApartment")
curve_41 = Curve(<curve referenced from the Rhino model>)
panel_185 = Panel("E:\DT4PED\DT4PED_Campus\Data\energy_data\07.21 HC\electricity_2022.csv")
user_text_37 = UserText(Content=curve_41, Keys="number_of_floors", UserTextMode=1)  # -> Content, Keys, Values
value_list_38 = ValueList({"Akademiska Hus", "Studentbostäder", "Chalmersfastigheter"}, selected="Studentbostäder")
brep_38 = Brep(<brep referenced from the Rhino model>)
building_38 = Building(
    name="HC",
    owner=value_list_38,
    footprints=flatten(curve_40),
    number_of_floors=flatten(Slider(4, range=0..10)),
    building_type=hb_building_programs_38,
    electric_demand=panel_185)  # -> out, flatten(building), area, fractional_hourly_electric_demand, electric_demand_from_program, electric_demand, total_energy_demand, total_installed_capacity; inputs footprints: list of Curve, number_of_floors: list, breps: list; same code as building
panel_186 = Panel(building_38.fractional_hourly_electric_demand)
panel_187 = Panel(building_38.electric_demand_from_program)
panel_188 = Panel(building_38.electric_demand)
panel_189 = Panel(building_38.building)

number_slider = Slider(0.45, range=0..1)  # disabled
number_slider_2 = Slider(0.3, range=0..1)  # disabled
number_slider_3 = Slider(0.25, range=0..1)  # disabled
merge = Merge(Data1=number_slider, Data2=number_slider_3, Data3=number_slider_2)  # disabled
number_slider_4 = Slider(0.2, range=0..1)  # disabled
number_slider_5 = Slider(0.3, range=0..1)  # disabled
value_list_39 = ValueList({"Community": "community", "Market": "market", "Custom": "custom"}, selected="Community")  # disabled
panel_190 = Panel("0.45,0.25,0.30")  # disabled

boolean_toggle = BooleanToggle(True)  # disabled
panel_191 = Panel("2025-07-20")  # disabled
ecom_analysis = ECOMAnalysis(analysis_period=panel_191, run=boolean_toggle)  # -> out, report, houly_balance, grid_import, grid_export, total_cost, flatten(battery_soc); inputs price_data: list; disabled
# ---------- ecom_analysis: Python ----------
#! python3
# r: numpy, pandas
import numpy as np
import pandas as pd
# ECOM Analysis: Energy Balance Simulation (MIT)
# Version: 0.0.4 (Input Length Validation + Run Toggle)
# Designed for use inside Grasshopper (GH) for Rhino by ECOM4Future

"""
Simulate energy flows in an Energy Community based on PV, battery, and grid.

Dispatch Logic (hourly):
1) PV → Direct Demand (distance priority: closest entities first)
2) PV → Battery Charging (if surplus PV)
3) Battery → Discharge (if PV insufficient for demand)
4) Grid → Import (last resort)

    Args:
        run: Boolean toggle to start/stop simulation.
        community: Energy Community object (from Merge ECOM Entities).
        price_data: Electricity price (float, list, or pandas Series/DataFrame).
        analysis_period: Optional [start_hour, end_hour] range (0–8759).

    Returns:
        report: Summary of self-consumption, self-sufficiency, cost.
        hourly_balance: Pandas DataFrame with columns:
            ['hour', 'pv_used', 'battery_charge', 'battery_discharge', 'grid_import', 'grid_export', 'soc']
        grid_import: Total grid import (kWh).
        grid_export: Total grid export (kWh).
        total_cost: Total cost of grid imports (SEK).
        battery_soc: Hourly battery state of charge (list).
"""

ghenv.Component.Name = 'ECOM Analysis'
ghenv.Component.NickName = 'ECOM_analysis'
ghenv.Component.Message = '0.0.4'
ghenv.Component.Category = 'ECOM4Future'
ghenv.Component.SubCategory = '5 :: Energy Community'
ghenv.Component.AdditionalHelpFromDocStrings = '2'

try:
    from ladybug_rhino.grasshopper import all_required_inputs
except ImportError:
    def all_required_inputs(comp): return True


class ECOMAnalysis:
    """Vectorized energy balance simulation for the Energy Community."""

    def __init__(self, community, price_data, analysis_period=None):
        self.community = community
        self.price_data = self._prepare_price_data(price_data)
        self.start_hour, self.end_hour = self._prepare_period(analysis_period)

        # Build demand & PV profiles BEFORE validation
        self.total_demand_profile = self._build_demand_profile()
        self.pv_profile = self._get_hourly_pv()

        # ✅ Validate and align all input lengths
        self._validate_and_crop_lengths()

        self.hours = np.arange(self.start_hour, self.start_hour + len(self.total_demand_profile))
        self.n_hours = len(self.hours)

        # Battery capacities
        self.battery_capacities = np.array(self._get_battery_capacities())
        self.soc = np.zeros((self.n_hours, len(self.battery_capacities)))

        # Simulation results
        self.results = pd.DataFrame(index=self.hours,
                                    columns=["pv_used", "battery_charge", "battery_discharge",
                                             "grid_import", "grid_export", "soc"],
                                    data=0.0)

        # Totals
        self.total_grid_import = 0.0
        self.total_grid_export = 0.0
        self.total_cost = 0.0

    def _prepare_price_data(self, price):
        if isinstance(price, (int, float)):
            return np.full(8760, float(price))
        elif isinstance(price, list):
            return np.array(price)
        elif isinstance(price, pd.Series):
            return price.values
        elif isinstance(price, pd.DataFrame) and "price" in price.columns:
            return price["price"].values
        else:
            raise TypeError("Price must be float, list, Series, or DataFrame with 'price' column.")

    def _prepare_period(self, period):
        if period and len(period) == 2:
            return max(0, period[0]), min(period[1], 8759)
        return 0, 8759

    def _build_demand_profile(self):
        profile = np.zeros(8760)
        for b in self.community.building:
            if isinstance(b.electric_demand, list) and len(b.electric_demand) == 8760:
                profile += np.array(b.electric_demand)
            else:
                profile += np.full(8760, b.total_energy_demand / 8760.0)
        return profile[self.start_hour:self.end_hour + 1]

    def _calc_total_pv_gen(self):
        total = 0.0
        for b in self.community.building:
            total += b.total_installed_capacity
        for pv in self.community.PV_plant:
            total += pv.capacity
        return total

    def _get_hourly_pv(self):
        return np.full(self.end_hour - self.start_hour + 1, self._calc_total_pv_gen() / 8760.0)

    def _get_battery_capacities(self):
        caps = []
        for b in self.community.building:
            for bat in getattr(b, "Battery", []):
                caps.append(bat.capacity)
        for bat in self.community.battery:
            caps.append(bat.capacity)
        return caps if caps else [0]

    def _validate_and_crop_lengths(self):
        """✅ Ensure all arrays have the same length; fallback to lowest common length."""
        lengths = [len(self.price_data), len(self.total_demand_profile), len(self.pv_profile)]
        min_len = min(lengths)

        if len(self.price_data) != min_len:
            self.price_data = self.price_data[:min_len]
        if len(self.total_demand_profile) != min_len:
            self.total_demand_profile = self.total_demand_profile[:min_len]
        if len(self.pv_profile) != min_len:
            self.pv_profile = self.pv_profile[:min_len]

    def run(self):
        soc = np.zeros(len(self.battery_capacities))

        for idx, hour in enumerate(self.hours):
            demand = self.total_demand_profile[idx]
            pv_available = self.pv_profile[idx]

            pv_used, battery_charge, battery_discharge, grid_import, grid_export = 0, 0, 0, 0, 0

            # 1) PV to Demand
            if pv_available >= demand:
                pv_used = demand
                pv_available -= demand
                demand = 0
            else:
                pv_used = pv_available
                demand -= pv_available
                pv_available = 0

            # 2) PV to Battery
            if pv_available > 0:
                for i, cap in enumerate(self.battery_capacities):
                    room = cap - soc[i]
                    if room > 0:
                        charge = min(pv_available, room)
                        soc[i] += charge
                        battery_charge += charge
                        pv_available -= charge
                        if pv_available <= 0:
                            break

            # 3) Battery Discharge
            if demand > 0:
                for i, _ in enumerate(self.battery_capacities):
                    if soc[i] > 0:
                        discharge = min(demand, soc[i])
                        soc[i] -= discharge
                        battery_discharge += discharge
                        demand -= discharge
                        if demand <= 0:
                            break

            # 4) Grid Import
            if demand > 0:
                grid_import = demand
                self.total_grid_import += grid_import
                self.total_cost += grid_import * self.price_data[idx]

            # Grid Export
            if pv_available > 0:
                grid_export = pv_available
                self.total_grid_export += grid_export

            self.results.loc[hour] = [pv_used, battery_charge, battery_discharge,
                                      grid_import, grid_export, soc.sum()]
            self.soc[idx, :] = soc

    def validate(self):
        total_demand = self.results["pv_used"].sum() + self.results["battery_discharge"].sum() + self.results["grid_import"].sum()
        self_sufficiency = 100 * (1 - self.total_grid_import / total_demand) if total_demand > 0 else 0
        self_consumption = 100 * ((self._calc_total_pv_gen() - self.total_grid_export) / self._calc_total_pv_gen()) if self._calc_total_pv_gen() > 0 else 0
        return (f"ECOM Analysis complete.\n"
                f"Total Demand: {total_demand:.1f} kWh | Grid Import: {self.total_grid_import:.1f} kWh | Grid Export: {self.total_grid_export:.1f} kWh\n"
                f"Self-Sufficiency: {self_sufficiency:.1f}% | Self-Consumption: {self_consumption:.1f}% | Total Cost: {self.total_cost:.1f} SEK")


# --- Grasshopper Main Logic ---
if all_required_inputs(ghenv.Component) and run:
    analysis = ECOMAnalysis(community, price_data, analysis_period)
    analysis.run()

    report = analysis.validate()
    hourly_balance = analysis.results.to_dict("records")  # GH-friendly
    grid_import = analysis.total_grid_import
    grid_export = analysis.total_grid_export
    total_cost = analysis.total_cost
    battery_soc = analysis.soc
else:
    report = "Toggle 'run' to True to execute the analysis."
    hourly_balance, grid_import, grid_export, total_cost, battery_soc = [], 0, 0, 0, []
# ---------- end ecom_analysis ----------
panel_192 = Panel(ecom_analysis.report)  # disabled

python_3_script = Python3Script(mode=value_list_39, threshold_sell=number_slider_4, threshold_buy=number_slider_5)  # -> out, report, dispatch_mode; disabled
# ---------- python_3_script: Python ----------
"""
Inputs:
    mode: string ("market", "community", "custom")
    weights: list of 3 floats [w_local, w_battery, w_grid] (optional, use Merge for 3 sliders)
    threshold_sell: float (optional, defaults based on mode)
    threshold_buy: float (optional, defaults based on mode)
Outputs:
    dispatch_mode: an object containing the selected dispatch strategy
    report: text report summarizing weights and thresholds
"""

# --- Default Values in SEK ---
DEFAULTS = {
    "market": {
        "weights": [0.2, 0.3, 0.5],      # prioritize selling
        "threshold_sell": 0.60,          # ~0.6 SEK/kWh typical feed-in
        "threshold_buy": 0.50            # ~0.5 SEK/kWh low-price buy trigger
    },
    "community": {
        "weights": [0.8, 0.15, 0.05],    # prioritize local use
        "threshold_sell": 1.00,          # only sell when price is very high
        "threshold_buy": 0.30            # buy cheaply if possible
    }
}

# --- Base Class ---
class DispatchMode:
    def dispatch(self, community_state):
        raise NotImplementedError("Implement in subclass.")

# --- Parametric Dispatch Class ---
class ParametricDispatch(DispatchMode):
    def __init__(self, mode_name, weights, threshold_sell, threshold_buy):
        # Flatten GH-style nested lists if needed
        if isinstance(weights, (tuple, list)) and len(weights) == 1 and isinstance(weights[0], (list, tuple)):
            weights = weights[0]

        if weights is None or len(weights) != 3:
            raise ValueError("Weights must be a list of exactly 3 numbers.")

        # Store values (convert everything to float)
        self.mode_name = mode_name
        self.w_local, self.w_battery, self.w_grid = [float(w) for w in weights]
        self.threshold_sell = float(threshold_sell)
        self.threshold_buy = float(threshold_buy)

    def dispatch(self, community_state):
        # Placeholder – actual logic will be in the ECOM dispatcher
        return {}

    def report(self):
        return f"""
Dispatch Mode Report
====================
Mode: {self.mode_name.capitalize()}
Priority Weights:
  - Local Consumption: {self.w_local:.2f}
  - Battery Charging:  {self.w_battery:.2f}
  - Grid Export:       {self.w_grid:.2f}

Thresholds:
  - Sell to Grid if Price >= {self.threshold_sell:.2f} SEK/kWh
  - Buy from Grid if Price <= {self.threshold_buy:.2f} SEK/kWh
"""

# --- Factory Function ---
def create_dispatch_mode(mode, weights=None, threshold_sell=None, threshold_buy=None):
    m = str(mode).lower().strip()

    # Convert thresholds to float if provided
    ts = float(threshold_sell) if threshold_sell not in (None, "") else None
    tb = float(threshold_buy) if threshold_buy not in (None, "") else None

    if m in DEFAULTS.keys() and (weights is None or len(weights) == 0):
        w = DEFAULTS[m]["weights"]
        ts = ts if ts is not None else DEFAULTS[m]["threshold_sell"]
        tb = tb if tb is not None else DEFAULTS[m]["threshold_buy"]
        return ParametricDispatch(m, w, ts, tb)

    elif m == "custom" and weights is not None and len(weights) == 3:
        ts = ts if ts is not None else 0.6
        tb = tb if tb is not None else 0.5
        return ParametricDispatch(m, weights, ts, tb)

    else:
        raise ValueError("Invalid mode or missing/incorrect weights for custom mode.")

# --- RUN ---
dispatch_mode = create_dispatch_mode(mode, weights, threshold_sell, threshold_buy)
report = dispatch_mode.report()
# ---------- end python_3_script ----------
panel_193 = Panel(python_3_script.report)  # disabled

boolean_toggle_2 = BooleanToggle(False)  # disabled
ecom_self_sufficiency = ECOMSelfSufficiencyAnalysis(run=boolean_toggle_2)  # -> out, report, self_sufficiency, self_consumption, grid_import, grid_export; disabled
# ---------- ecom_self_sufficiency: Python ----------
# ECOM Self-Sufficiency Analysis (MIT)
# Version: 0.0.1
# Designed for use inside Grasshopper (GH) for Rhino by ECOM4Future

"""
Calculate self-sufficiency and self-consumption rates for the energy community.

    Args:
        run: Boolean toggle to start/stop analysis.
        community: Energy Community object (from Merge ECOM Entities).
        analysis_period: Optional [start_hour, end_hour] range (0–8759).

    Returns:
        report: Summary of key indicators.
        hourly_metrics: List of dictionaries per hour:
            {hour, demand, pv_generation, battery_discharge, grid_import, grid_export}.
        self_sufficiency: (%) Share of demand met by PV + battery.
        self_consumption: (%) Share of PV generation consumed locally.
        grid_import: Total grid import (kWh).
        grid_export: Total grid export (kWh).
"""

ghenv.Component.Name = 'ECOM Self-Sufficiency Analysis'
ghenv.Component.NickName = 'ECOM_self_sufficiency'
ghenv.Component.Message = '0.0.1'
ghenv.Component.Category = 'ECOM4Future'
ghenv.Component.SubCategory = '6 :: Analysis'
ghenv.Component.AdditionalHelpFromDocStrings = '2'

import numpy as np
import pandas as pd

try:
    from ladybug_rhino.grasshopper import all_required_inputs
except ImportError:
    def all_required_inputs(comp): return True


class SelfSufficiencyAnalysis:
    def __init__(self, community, analysis_period=None):
        self.community = community
        self.start_hour, self.end_hour = self._prepare_period(analysis_period)
        self.hours = np.arange(self.start_hour, self.end_hour + 1)
        self.n_hours = len(self.hours)

        self.total_demand = self._build_demand_profile()
        self.total_pv_gen = self._build_pv_profile()
        self.battery_discharge = self._estimate_battery_discharge()

        self.grid_import = 0.0
        self.grid_export = 0.0
        self.hourly = []

    def _prepare_period(self, period):
        if period and len(period) == 2:
            return max(0, period[0]), min(period[1], 8759)
        return 0, 8759

    def _build_demand_profile(self):
        profile = np.zeros(8760)
        for b in self.community.building:
            if isinstance(b.electric_demand, list) and len(b.electric_demand) == 8760:
                profile += np.array(b.electric_demand)
            else:
                profile += np.full(8760, b.total_energy_demand / 8760.0)
        return profile[self.start_hour:self.end_hour + 1]

    def _build_pv_profile(self):
        total_pv = 0.0
        for b in self.community.building:
            total_pv += b.total_pv_capacity
        for pv in self.community.PV_plant:
            total_pv += pv.capacity
        return np.full(self.n_hours, total_pv * 1000 / 8760.0)  # convert kW → hourly kWh (flat est.)

    def _estimate_battery_discharge(self):
        total_discharge = np.zeros(self.n_hours)
        bat_caps = []
        for b in self.community.building:
            for bat in getattr(b, "battery", []):
                bat_caps.append(bat.capacity)
        for bat in self.community.battery:
            bat_caps.append(bat.capacity)

        if not bat_caps:
            return total_discharge

        # Simple discharge estimation: use 30% of total battery capacity daily distributed evenly
        total_bat_capacity = sum(bat_caps)
        avg_daily_discharge = total_bat_capacity * 0.3 / 24.0
        return np.full(self.n_hours, avg_daily_discharge)

    def run(self):
        for i, hour in enumerate(self.hours):
            demand = self.total_demand[i]
            pv_gen = self.total_pv_gen[i]
            bat_discharge = min(demand, self.battery_discharge[i])
            demand_after_bat = demand - bat_discharge

            if pv_gen >= demand_after_bat:
                pv_used = demand_after_bat
                self.grid_export += pv_gen - pv_used
                grid_import = 0.0
            else:
                pv_used = pv_gen
                grid_import = demand_after_bat - pv_gen
                self.grid_import += grid_import

            self.hourly.append({
                "hour": int(hour),
                "demand": float(demand),
                "pv_generation": float(pv_gen),
                "battery_discharge": float(bat_discharge),
                "grid_import": float(grid_import),
                "grid_export": float(max(0, pv_gen - pv_used))
            })

    def validate(self):
        total_demand = np.sum(self.total_demand)
        pv_used_total = sum(h["pv_generation"] - h["grid_export"] for h in self.hourly)
        self_sufficiency = 100 * (1 - self.grid_import / total_demand) if total_demand > 0 else 0
        self_consumption = 100 * (pv_used_total / np.sum(self.total_pv_gen)) if np.sum(self.total_pv_gen) > 0 else 0

        return (f"Self-Sufficiency Analysis complete.\n"
                f"Total Demand: {total_demand:.1f} kWh | Grid Import: {self.grid_import:.1f} kWh | "
                f"Grid Export: {self.grid_export:.1f} kWh\n"
                f"Self-Sufficiency: {self_sufficiency:.1f}% | Self-Consumption: {self_consumption:.1f}%"), \
               self_sufficiency, self_consumption


# --- Grasshopper Main Logic ---
if all_required_inputs(ghenv.Component) and run:
    analysis = SelfSufficiencyAnalysis(community, analysis_period)
    analysis.run()

    report, self_sufficiency, self_consumption = analysis.validate()
    hourly_metrics = analysis.hourly
    grid_import = analysis.grid_import
    grid_export = analysis.grid_export
else:
    report = "Toggle 'run' to True to execute analysis."
    hourly_metrics, self_sufficiency, self_consumption, grid_import, grid_export = [], 0, 0, 0, 0
# ---------- end ecom_self_sufficiency ----------
panel_194 = Panel(ecom_self_sufficiency.grid_export)  # disabled

boolean_toggle_3 = BooleanToggle(False)  # disabled
panel_195 = Panel("0-20")  # disabled
load_gen_profile = LoadGenerationProfiling(analysis_period=panel_195, run=boolean_toggle_3)  # -> out, report, load_profile, generation_profile, profile_df; disabled
# ---------- load_gen_profile: Python ----------
# Load & Generation Profiling: Energy Community (MIT)
# Version: 0.0.2
# Designed for use inside Grasshopper (GH) for Rhino by ECOM4Future

"""
Analyze load (demand) and generation (PV production) profiles of an Energy Community.

    Args:
        community: Energy Community object (from Merge ECOM Entities).
        analysis_period: Flexible analysis period:
            - None = full year (default)
            - [start_hour, end_hour] (0–8759)
            - ["YYYY-MM-DD", "YYYY-MM-DD"]
            - ["YYYY-MM-DD HH:MM", "YYYY-MM-DD HH:MM"]

    Returns:
        report: Summary of demand, generation, and self-consumption ratio.
        load_profile: Hourly demand profile (list).
        generation_profile: Hourly PV generation profile (list).
        profile_df: List of dicts [{hour, load, generation}] for CSV/export.
"""

ghenv.Component.Name = 'Load & Generation Profiling'
ghenv.Component.NickName = 'load_gen_profile'
ghenv.Component.Message = '0.0.2'
ghenv.Component.Category = 'ECOM4Future'
ghenv.Component.SubCategory = '5 :: Energy Community'
ghenv.Component.AdditionalHelpFromDocStrings = '2'

import numpy as np
import pandas as pd

try:
    from ladybug_rhino.grasshopper import all_required_inputs
except ImportError:
    def all_required_inputs(comp): return True


class LoadGenerationProfiler:
    def __init__(self, community, analysis_period=None):
        self.community = community
        self.start_hour, self.end_hour = self._parse_analysis_period(analysis_period)

        self.load_profile = self._build_load_profile()
        self.generation_profile = self._build_generation_profile()

        self.load_profile = self.load_profile[self.start_hour:self.end_hour + 1]
        self.generation_profile = self.generation_profile[self.start_hour:self.end_hour + 1]

    def _parse_analysis_period(self, period):
        if not period:
            return 0, 8759
        try:
            if all(isinstance(p, (int, float)) for p in period):
                return int(period[0]), int(period[1])
            if all(isinstance(p, str) for p in period):
                start = pd.to_datetime(period[0])
                end = pd.to_datetime(period[1])
                start_hour = (start.dayofyear - 1) * 24 + start.hour
                end_hour = (end.dayofyear - 1) * 24 + end.hour
                return int(start_hour), int(end_hour)
        except:
            pass
        return 0, 8759

    def _build_load_profile(self):
        profile = np.zeros(8760)
        for b in self.community.building:
            if isinstance(b.electric_demand, list) and len(b.electric_demand) == 8760:
                profile += np.array(b.electric_demand)
            else:
                profile += np.full(8760, b.total_energy_demand / 8760.0)
        return profile

    def _build_generation_profile(self):
        profile = np.zeros(8760)
        for b in self.community.building:
            for pv in getattr(b, "PV_plant", []):
                if hasattr(pv, "hourly_production"):
                    profile += np.array(pv.hourly_production)
                else:
                    profile += np.full(8760, (pv.total_power / 1000.0) * 1000 / 8760.0)
        for pv in self.community.PV_plant:
            if hasattr(pv, "hourly_production"):
                profile += np.array(pv.hourly_production)
            else:
                profile += np.full(8760, (pv.total_power / 1000.0) * 1000 / 8760.0)
        return profile

    def validate(self):
        total_load = np.sum(self.load_profile)
        total_gen = np.sum(self.generation_profile)
        self_consumption = 100 * min(total_gen, total_load) / total_gen if total_gen > 0 else 0
        return (f"Load & Generation Profiling Complete.\n"
                f"Total Load: {total_load:.1f} kWh | Total Generation: {total_gen:.1f} kWh\n"
                f"Self-Consumption Ratio: {self_consumption:.1f}%")

    def profile_dataframe(self):
        return [{"hour": i, "load": l, "generation": g}
                for i, (l, g) in enumerate(zip(self.load_profile, self.generation_profile))]


# --- Main Grasshopper Logic ---
if all_required_inputs(ghenv.Component):
    profiler = LoadGenerationProfiler(community, analysis_period)
    report = profiler.validate()
    load_profile = profiler.load_profile
    generation_profile = profiler.generation_profile
    profile_df = profiler.profile_dataframe()
# ---------- end load_gen_profile ----------
panel_196 = Panel(load_gen_profile.profile_df)  # disabled

boolean_toggle_4 = BooleanToggle(False)  # disabled
ecom_grid_analysis = ECOMGridInteractionAnalysis(run=boolean_toggle_4)  # -> out, report, total_import_cost, total_export_revenue, net_balance, peak_import_hour, peak_export_hour, hourly_grid_metrics; disabled
# ---------- ecom_grid_analysis: Python ----------
#! python3
# r: numpy, pandas
import numpy as np
import pandas as pd

# ECOM Grid Interaction Analysis (MIT)
# Version: 0.0.3 (Updated for hourly_dispatch input from ECOM Dispatcher)
# Designed for use inside Grasshopper (GH) for ECOM4Future

"""
Analyze grid imports/exports and calculate economic balance for the energy community.

    Args:
        run: Boolean toggle to execute analysis.
        hourly_dispatch: Output from ECOM Dispatcher (list of hourly dicts or table).
        electricity_market_price: Float, list, or CSV/Series (SEK/kWh).
        feed_in_tariff: (Optional) Fixed price for selling energy to the grid (SEK/kWh).
        analysis_period: Optional [start_hour, end_hour] range (0–8759).

    Returns:
        report: Summary of import/export economics.
        total_import_cost: Total cost of grid imports (SEK).
        total_export_revenue: Total revenue from grid exports (SEK).
        net_balance: Revenue - Cost (SEK).
        peak_import_hour: Hour with highest grid import.
        peak_export_hour: Hour with highest grid export.
        hourly_grid_metrics: List of hourly records:
            {hour, import_kwh, export_kwh, cost, revenue}.
"""

ghenv.Component.Name = 'ECOM Grid Interaction Analysis'
ghenv.Component.NickName = 'ECOM_grid_analysis'
ghenv.Component.Message = '0.0.3'
ghenv.Component.Category = 'ECOM4Future'
ghenv.Component.SubCategory = '6 :: Energy Community Analysis'
ghenv.Component.AdditionalHelpFromDocStrings = '2'

try:
    from ladybug_rhino.grasshopper import all_required_inputs
except ImportError:
    def all_required_inputs(comp): return True


class ECOMGridInteraction:
    def __init__(self, hourly_dispatch, electricity_market_price, feed_in_tariff=None, analysis_period=None):
        # ✅ Ensure dispatcher output is converted to consistent list of dicts
        self.hourly_dispatch = self._normalize_dispatch(hourly_dispatch)
        self.prices = self._prepare_price(electricity_market_price)
        self.feed_in_tariff = feed_in_tariff if feed_in_tariff is not None else np.mean(self.prices) * 0.8
        self.start_hour, self.end_hour = self._prepare_period(analysis_period)
        self.hours = np.arange(self.start_hour, self.end_hour + 1)

        # Extract imports/exports (fallback to 0 if missing)
        self.hourly_import = np.array([h.get("grid_import", 0.0) for h in self.hourly_dispatch])
        self.hourly_export = np.array([h.get("grid_export", 0.0) for h in self.hourly_dispatch])

        # Restrict to analysis period
        self.hourly_import = self.hourly_import[self.start_hour:self.end_hour + 1]
        self.hourly_export = self.hourly_export[self.start_hour:self.end_hour + 1]
        self.prices = self.prices[self.start_hour:self.end_hour + 1]

        # Outputs
        self.total_import_cost = 0.0
        self.total_export_revenue = 0.0
        self.net_balance = 0.0
        self.results = pd.DataFrame()

    def _normalize_dispatch(self, dispatch):
        """Ensure input is a list of dicts regardless of GH output type."""
        if isinstance(dispatch, pd.DataFrame):
            return dispatch.to_dict("records")
        if isinstance(dispatch, list) and all(isinstance(d, dict) for d in dispatch):
            return dispatch
        if isinstance(dispatch, list) and all(isinstance(d, (list, tuple)) for d in dispatch):
            # Assume table-like: [hour, grid_import, grid_export,...]
            return [
                {"hour": row[0], "grid_import": row[4] if len(row) > 4 else 0.0,
                 "grid_export": row[5] if len(row) > 5 else 0.0}
                for row in dispatch
            ]
        raise TypeError("hourly_dispatch must be a list of dicts, a table-like list, or a DataFrame.")

    def _prepare_price(self, price):
        if isinstance(price, (int, float)):
            return np.full(8760, float(price))
        elif isinstance(price, list):
            return np.array(price)
        elif isinstance(price, pd.Series):
            return price.values
        elif isinstance(price, pd.DataFrame) and "price" in price.columns:
            return price["price"].values
        else:
            raise TypeError("electricity_market_price must be float, list, Series, or DataFrame with 'price' column.")

    def _prepare_period(self, period):
        if period and len(period) == 2:
            return max(0, period[0]), min(period[1], 8759)
        return 0, 8759

    def run(self):
        cost = self.hourly_import * self.prices
        revenue = self.hourly_export * self.feed_in_tariff

        self.total_import_cost = cost.sum()
        self.total_export_revenue = revenue.sum()
        self.net_balance = self.total_export_revenue - self.total_import_cost

        self.results = pd.DataFrame({
            "hour": self.hours,
            "import_kwh": self.hourly_import,
            "export_kwh": self.hourly_export,
            "cost": cost,
            "revenue": revenue
        })

    def validate(self):
        if self.results.empty:
            return "No data available for analysis."
        peak_import_hour = self.results.iloc[self.results["import_kwh"].idxmax()]["hour"]
        peak_export_hour = self.results.iloc[self.results["export_kwh"].idxmax()]["hour"]

        return (f"ECOM Grid Interaction Analysis complete.\n"
                f"Total Import Cost: {self.total_import_cost:.1f} SEK | "
                f"Total Export Revenue: {self.total_export_revenue:.1f} SEK | "
                f"Net Balance: {self.net_balance:.1f} SEK\n"
                f"Peak Import Hour: {peak_import_hour} | Peak Export Hour: {peak_export_hour}")


# --- Grasshopper Main Logic ---
if all_required_inputs(ghenv.Component) and run:
    grid_analysis = ECOMGridInteraction(hourly_dispatch, electricity_market_price, feed_in_tariff, analysis_period)
    grid_analysis.run()

    report = grid_analysis.validate()
    total_import_cost = grid_analysis.total_import_cost
    total_export_revenue = grid_analysis.total_export_revenue
    net_balance = grid_analysis.net_balance
    peak_import_hour = int(grid_analysis.results["hour"][grid_analysis.results["import_kwh"].idxmax()])
    peak_export_hour = int(grid_analysis.results["hour"][grid_analysis.results["export_kwh"].idxmax()])
    hourly_grid_metrics = grid_analysis.results.to_dict("records")
else:
    report = "Toggle 'run' to True to execute the grid analysis."
    total_import_cost = total_export_revenue = net_balance = 0
    peak_import_hour = peak_export_hour = None
    hourly_grid_metrics = []
# ---------- end ecom_grid_analysis ----------
panel_197 = Panel(ecom_grid_analysis.peak_export_hour)  # disabled

boolean_toggle_5 = BooleanToggle(False)  # disabled
ecom_battery_utilization = ECOMBatteryUtilization(run=boolean_toggle_5)  # -> out, report, hourly_battery_metrics, avg_daily_cycles, avg_soc, max_soc, min_soc; disabled
# ---------- ecom_battery_utilization: Python ----------
# ECOM Battery Utilization Analysis (MIT)
# Version: 0.0.2 (Supports battery_soc override from Dispatcher)
# Designed for use inside Grasshopper (GH) for Rhino by ECOM4Future

"""
Analyze battery utilization patterns in the Energy Community.

Priority:
- If battery_soc (from Dispatcher) is connected → use it directly.
- Else → estimate based on community batteries (roughly constant or no cycles).

Args:
    run: Boolean toggle to execute simulation.
    community: Energy Community object (from Merge ECOM Entities).
    battery_soc: (Optional) Hourly SOC list from ECOM_dispatcher (list of lists).
    analysis_period: Optional [start_hour, end_hour] range (0–8759).

Returns:
    report: Summary of battery utilization.
    hourly_battery_metrics: List of dicts [{hour, avg_soc, cycles_estimated}]
    avg_daily_cycles: Average daily charge/discharge cycles per battery.
    avg_soc: Average SOC across period (%).
    max_soc: Maximum SOC observed (%).
    min_soc: Minimum SOC observed (%).
"""

ghenv.Component.Name = 'ECOM Battery Utilization'
ghenv.Component.NickName = 'ECOM_battery_utilization'
ghenv.Component.Message = '0.0.2'
ghenv.Component.Category = 'ECOM4Future'
ghenv.Component.SubCategory = '5 :: Energy Community'
ghenv.Component.AdditionalHelpFromDocStrings = '2'

import numpy as np
import pandas as pd

try:
    from ladybug_rhino.grasshopper import all_required_inputs
except ImportError:
    def all_required_inputs(comp): return True


class BatteryUtilization:
    def __init__(self, community, analysis_period=None, battery_soc=None):
        self.community = community
        self.start_hour, self.end_hour = self._prepare_period(analysis_period)
        self.hours = np.arange(self.start_hour, self.end_hour + 1)
        self.n_hours = len(self.hours)

        # SOC data (priority to Dispatcher SOC)
        self.soc_matrix = self._prepare_soc(battery_soc)
        self.avg_soc_profile = self.soc_matrix.mean(axis=1) if self.soc_matrix.size > 0 else np.zeros(self.n_hours)

        # Results
        self.hourly_metrics = []
        self.avg_daily_cycles = 0.0
        self.avg_soc = 0.0
        self.max_soc = 0.0
        self.min_soc = 0.0

    def _prepare_period(self, period):
        if period and len(period) == 2:
            return max(0, period[0]), min(period[1], 8759)
        return 0, 8759

    def _prepare_soc(self, soc_input):
        """Use Dispatcher SOC if provided, else estimate from community."""
        if soc_input is not None and isinstance(soc_input, list) and len(soc_input) > 0:
            # Convert to numpy array (hour x battery)
            return np.array(soc_input)
        else:
            # Fallback: Approximate SOC (static at 50% if no dispatcher run)
            capacities = self._get_battery_capacities()
            return np.full((self.n_hours, len(capacities)), 0.5 * np.array(capacities)) if capacities else np.zeros((self.n_hours, 1))

    def _get_battery_capacities(self):
        caps = []
        for b in self.community.building:
            for bat in getattr(b, "Battery", []):
                caps.append(bat.capacity)
        for bat in self.community.battery:
            caps.append(bat.capacity)
        return caps

    def run(self):
        if self.soc_matrix.size == 0:
            return

        # Calculate cycles (roughly based on SOC fluctuation amplitude)
        delta_soc = np.abs(np.diff(self.soc_matrix, axis=0))
        cycles_per_battery = delta_soc.sum(axis=0) / (2 * self.soc_matrix.max(axis=0))
        self.avg_daily_cycles = cycles_per_battery.mean() / (self.n_hours / 24.0)

        # Aggregate SOC statistics
        self.avg_soc = self.avg_soc_profile.mean()
        self.max_soc = self.avg_soc_profile.max()
        self.min_soc = self.avg_soc_profile.min()

        # Hourly report
        for idx, hour in enumerate(self.hours):
            self.hourly_metrics.append({
                "hour": int(hour),
                "avg_soc": float(self.avg_soc_profile[idx]),
                "cycles_estimated": float(delta_soc[idx - 1].mean()) if idx > 0 else 0
            })

    def validate(self):
        source = "Dispatcher SOC" if self.soc_matrix.size > 0 else "Community (estimated)"
        return (f"ECOM Battery Utilization complete.\n"
                f"Data Source: {source}\n"
                f"Avg SOC: {self.avg_soc:.1f}% | Max SOC: {self.max_soc:.1f}% | Min SOC: {self.min_soc:.1f}%\n"
                f"Avg Daily Cycles: {self.avg_daily_cycles:.2f}")


# --- Grasshopper Main Logic ---
if all_required_inputs(ghenv.Component) and run:
    analyzer = BatteryUtilization(community, analysis_period, battery_soc)
    analyzer.run()

    report = analyzer.validate()
    hourly_battery_metrics = analyzer.hourly_metrics
    avg_daily_cycles = analyzer.avg_daily_cycles
    avg_soc = analyzer.avg_soc
    max_soc = analyzer.max_soc
    min_soc = analyzer.min_soc
else:
    report = "Toggle 'run' to True to execute battery utilization analysis."
    hourly_battery_metrics, avg_daily_cycles, avg_soc, max_soc, min_soc = [], 0, 0, 0, 0
# ---------- end ecom_battery_utilization ----------
panel_198 = Panel(ecom_battery_utilization.report)  # disabled

boolean_toggle_6 = BooleanToggle(False)  # disabled
ecom_scenario_comparison = ECOMScenarioComparison(run=boolean_toggle_6)  # -> out, report, comparison_table, best_performance; disabled
# ---------- ecom_scenario_comparison: Python ----------
# ECOM Scenario Comparison (MIT)
# Version: 0.0.1
# Designed for use inside Grasshopper (GH) for Rhino by ECOM4Future

"""
Compare multiple energy community dispatch scenarios based on key KPIs.

Args:
    run: Boolean toggle to execute analysis.
    scenarios: List of hourly_dispatch outputs from ECOM_dispatcher (one per scenario).
    scenario_names: Optional list of scenario names (must match length of scenarios).
    analysis_period: Optional [start_hour, end_hour] range (0–8759).

Returns:
    report: Text summary comparing scenarios.
    comparison_table: List of dicts [{scenario, self_sufficiency, self_consumption, total_cost, total_revenue, net_balance, total_carbon_imported}]
    best_performance: Scenario name with highest self-sufficiency.
"""

ghenv.Component.Name = 'ECOM Scenario Comparison'
ghenv.Component.NickName = 'ECOM_scenario_comparison'
ghenv.Component.Message = '0.0.1'
ghenv.Component.Category = 'ECOM4Future'
ghenv.Component.SubCategory = '6 :: Energy Community Analysis'
ghenv.Component.AdditionalHelpFromDocStrings = '2'

import numpy as np
import pandas as pd

try:
    from ladybug_rhino.grasshopper import all_required_inputs
except ImportError:
    def all_required_inputs(comp): return True

class ECOMScenarioComparison:
    def __init__(self, scenarios, scenario_names=None, analysis_period=None):
        self.scenarios = scenarios
        self.names = scenario_names if scenario_names and len(scenario_names) == len(scenarios) else [f"Scenario_{i+1}" for i in range(len(scenarios))]
        self.start_hour, self.end_hour = self._prepare_period(analysis_period)
        self.results = []

    def _prepare_period(self, period):
        if period and len(period) == 2:
            return max(0, period[0]), min(period[1], 8759)
        return 0, 8759

    def run(self):
        for name, sc in zip(self.names, self.scenarios):
            df = pd.DataFrame(sc)
            df = df.iloc[self.start_hour:self.end_hour + 1]

            total_pv = df["pv_used"].sum() + df["p2p_energy"].sum() + df["grid_export"].sum()
            total_demand = df["pv_used"].sum() + df["battery_discharge"].sum() + df["grid_import"].sum()
            total_import = df["grid_import"].sum()
            total_export = df["grid_export"].sum()

            self_sufficiency = 100 * (1 - total_import / total_demand) if total_demand > 0 else 0
            self_consumption = 100 * ((total_pv - total_export) / total_pv) if total_pv > 0 else 0
            total_cost = (df["grid_import"] * 1).sum()  # assumes cost already applied in dispatcher if needed
            total_revenue = df["p2p_energy"].sum() + df["grid_export"].sum()
            net_balance = total_revenue - total_cost
            total_carbon = df.get("grid_import", pd.Series()).sum()  # fallback, will be extended later for carbon intensity

            self.results.append({
                "scenario": name,
                "self_sufficiency": round(self_sufficiency, 1),
                "self_consumption": round(self_consumption, 1),
                "total_cost": round(total_cost, 1),
                "total_revenue": round(total_revenue, 1),
                "net_balance": round(net_balance, 1),
                "total_carbon_imported": round(total_carbon, 1)
            })

    def validate(self):
        if not self.results:
            return "No scenarios analyzed."
        best = max(self.results, key=lambda x: x["self_sufficiency"])
        lines = [f"{r['scenario']}: SS={r['self_sufficiency']}%, Cost={r['total_cost']} SEK, Carbon={r['total_carbon_imported']} kgCO₂" for r in self.results]
        return f"ECOM Scenario Comparison complete.\nBest Scenario: {best['scenario']} (highest self-sufficiency)\n" + "\n".join(lines)

# --- Grasshopper Main Logic ---
if all_required_inputs(ghenv.Component) and run:
    comparison = ECOMScenarioComparison(scenarios, scenario_names, analysis_period)
    comparison.run()

    report = comparison.validate()
    comparison_table = comparison.results
    best_performance = max(comparison.results, key=lambda x: x["self_sufficiency"])["scenario"] if comparison.results else None
else:
    report = "Toggle 'run' to True to execute the scenario comparison."
    comparison_table, best_performance = [], None
# ---------- end ecom_scenario_comparison ----------
panel_199 = Panel(ecom_scenario_comparison.report)  # disabled

pvmodule_9 = PVModule(
    name="MC2 350W Panel",
    rating=Slider(350, range=0..1000),
    size_x=Slider(1, range=0..1),
    size_y=Slider(2, range=0..10),
    cost=Slider(3100, range=0..10000),
    embodied_co2=Slider(615, range=0..1000))  # -> out, PV_module, efficiency, area, total_cost, total_embodied_co2; same code as pvmodule
panel_200 = Panel(pvmodule_9.PV_module)

number_slider_6 = Slider(7, range=0..10)
analysisperiod = LBAnalysisPeriod(
    start_month=number_slider_6,
    start_day=Slider(20, range=0..100),
    start_hour=0,
    end_month=number_slider_6,
    end_day=Slider(21, range=0..100))  # -> period, hoys, dates; plug-in component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
panel_201 = Panel(analysisperiod.hoys)

pvmodule_10 = PVModule(
    name="Default 400W Panel",
    rating=Slider(400, range=0..1000),
    size_x=Slider(1, range=0..1),
    size_y=Slider(2, range=0..10),
    cost=Slider(3100, range=0..10000),
    embodied_co2=Slider(615, range=0..1000))  # -> out, PV_module, efficiency, area, total_cost, total_embodied_co2; same code as pvmodule
panel_202 = Panel(pvmodule_10.PV_module)

value_list_40 = ValueList({"SE1", "SE2", "SE3", "SE4"}, selected="SE3")
value_list_41 = ValueList({"EUR", "SEK"}, selected="SEK")
nordpool_price = NordPoolPriceFetcher(delivery_area=value_list_40, start_date="2025-07-20", end_date="2025-07-21", currency=value_list_41)  # -> out, timestamps, prices, price_df, avg_price, min_price, max_price
# ---------- nordpool_price: Python ----------
#! python3
# r: numpy, pandas
import numpy as np
import pandas as pd
# Nord Pool Multi-Day Price Fetcher (MIT)
# Version: 0.0.4
# Designed for Grasshopper (GH) by ECOM4Future

"""
Fetch hourly day-ahead electricity prices from Nord Pool for a date range.

    Args:
        delivery_area: Price area (e.g., "SE3").
        start_date: Start date (YYYY-MM-DD).
        end_date: End date (YYYY-MM-DD).
        currency: Currency (default "SEK").

    Returns:
        report: Summary of fetched data.
        timestamps: List of hourly timestamps (string).
        prices: List of hourly prices (SEK/kWh).
        avg_price: Average hourly price.
        min_price: Minimum hourly price.
        max_price: Maximum hourly price.
        price_df: List of dictionaries [{timestamp: ..., price: ...}]
"""

ghenv.Component.Name = 'Nord Pool Price Fetcher'
ghenv.Component.NickName = 'nordpool_price'
ghenv.Component.Message = '0.0.1'
ghenv.Component.Category = 'ECOM4Future'
ghenv.Component.SubCategory = '5 :: Energy Community'
ghenv.Component.AdditionalHelpFromDocStrings = '2'

import json
import System
from System.Net import WebClient
from System import DateTime

try:
    from ladybug_rhino.grasshopper import all_required_inputs
except ImportError:
    def all_required_inputs(comp): return True


class NordPoolPriceFetcher:
    BASE_URL = "https://dataportal-api.nordpoolgroup.com/api/DayAheadPrices"

    def __init__(self, delivery_area, start_date, end_date, currency="SEK"):
        self.delivery_area = delivery_area
        self.currency = currency
        self.start_date = DateTime.Parse(start_date)
        self.end_date = DateTime.Parse(end_date)

        self.timestamps, self.prices = self._fetch_multiple_days()

    def _fetch_multiple_days(self):
        ts, ps = [], []
        wc = WebClient()

        current = self.start_date
        while current <= self.end_date:
            date_str = current.ToString("yyyy-MM-dd")
            url = "{}?date={}&market=DayAhead&deliveryArea={}&currency={}".format(
                self.BASE_URL, date_str, self.delivery_area, self.currency
            )

            try:
                response = wc.DownloadString(url)
                data = json.loads(response)
                entries = data.get("multiAreaEntries", [])
            except Exception as e:
                print("Warning: Could not fetch {} ({})".format(date_str, e))
                current = current.AddDays(1)
                continue

            for i, entry in enumerate(entries):
                try:
                    price_mwh = entry["entryPerArea"].get(self.delivery_area)
                    if price_mwh is not None:
                        price_kwh = float(price_mwh) / 1000.0
                        ts.append("{} {:02d}:00".format(date_str, i))
                        ps.append(price_kwh)
                except:
                    continue

            current = current.AddDays(1)

        return ts, ps

    def avg_price(self): return sum(self.prices) / len(self.prices) if self.prices else 0
    def min_price(self): return min(self.prices) if self.prices else 0
    def max_price(self): return max(self.prices) if self.prices else 0

    def price_df(self):
        """Return Pandas DataFrame if available, else list of dicts."""
        try:
            import pandas as pd
            return pd.DataFrame({"timestamp": self.timestamps, "price": self.prices})
        except ImportError:
            return [{"timestamp": t, "price": p} for t, p in zip(self.timestamps, self.prices)]


    def validate(self):
        return ("Fetched {} hourly prices for {} from {} to {} ({}).\n"
                "Avg: {:.3f} {} | Min: {:.3f} | Max: {:.3f}"
                .format(len(self.prices), self.delivery_area,
                        self.start_date.ToString("yyyy-MM-dd"),
                        self.end_date.ToString("yyyy-MM-dd"),
                        self.currency, self.avg_price(),
                        self.currency, self.min_price(), self.max_price()))


# --- Grasshopper Main Logic ---
if all_required_inputs(ghenv.Component):
    fetcher = NordPoolPriceFetcher(delivery_area, start_date, end_date, currency)
    timestamps = fetcher.timestamps
    prices = fetcher.prices
    report = fetcher.validate()
    avg_price = fetcher.avg_price()
    min_price = fetcher.min_price()
    max_price = fetcher.max_price()
    price_df = fetcher.price_df()
# ---------- end nordpool_price ----------
panel_203 = Panel(nordpool_price.price_df)

surface_8 = Surface(<surface referenced from the Rhino model>)
pvplant_7 = PVPlant(
    name="community PV-Plant",
    surfaces=surface_8,
    PV_module=pvmodule_9.PV_module,
    percentage=Slider(100, range=0..100),
    system_loss=Slider(14, range=0..100),
    run=Toggle(True))  # -> out, report, PV_plant, azimuth, slope, number_panels, installed_capacity, total_cost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; inputs surfaces: list of Brep; same code as pvplant

surface_9 = Surface([<surface referenced from the Rhino model> x2])
pvplant_8 = PVPlant(
    name="SB2-PV",
    surfaces=surface_9,
    PV_module=pvmodule_10.PV_module,
    percentage=Slider(61, range=0..100),
    system_loss=Slider(14, range=0..100),
    run=Toggle(True))  # -> out, report, flatten(PV_plant), azimuth, slope, number_panels, installed_capacity, total_cost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; inputs surfaces: list of Brep; same code as pvplant
panel_204 = Panel(pvplant_8.hourly_result)

panel_205 = Panel("""1
1
0
0
0
1
0
1
0
1
0
1
1
0
0
0
1
0
1
0
1
0
1
1""")
electricvehicle = ElectricVehicle(
    name="EV1",
    schedule=panel_205,
    analysis_period=analysisperiod.hoys,
    capacity=Slider(50, range=0..100),
    is_hybrid=Toggle(False),
    efficiency=Slider(16, range=0..100),
    daily_distance=Slider(20, range=0..100),
    max_charging_power=Slider(2.5, range=0..10),
    v2g_enabled=Toggle(True),
    embodied_co2=Slider(7.3, range=0..10))  # -> out, EV; inputs name: String, schedule: list of Double, analysis_period: list of Int32
# ---------- electricvehicle: Python ----------
# Electric Vehicle: A Plugin for EV Analysis (MIT)
# Version: 0.0.2
# Designed for use inside Grasshopper (GH) for Rhino by ECOM4Future

"""
Create an Electric Vehicle (EV) object compatible with Honeybee schedules.
_

    Args:
        name: EV name or model identifier.
        schedule: A Honeybee schedule (ScheduleRuleset or ScheduleFixedInterval)
            or a constant value/list to define EV availability (0 = away, 1 = available).
        capacity: Battery capacity (kWh).
        is_hybrid: Boolean (True = PHEV, False = BEV).
        efficiency: EV energy consumption (kWh/100 km).
        daily_distance: Average daily driving distance (km/day).
        max_charging_power: Maximum charging power (kW).
        v2g_enabled: Boolean for Vehicle-to-Grid.
        embodied_co2: Battery embodied carbon (kgCO2e/kWh).

    Returns:
        out: Validation message.
        EV: EV object.
        daily_energy_demand: Estimated daily charging demand (kWh/day).
        usable_capacity: Usable battery capacity (kWh).
        total_embodied_co2: Total embodied CO₂ (kgCO2e).
"""

ghenv.Component.Name = 'ElectricVehicle'
ghenv.Component.NickName = 'ElectricVehicle'
ghenv.Component.Message = '0.0.1'
ghenv.Component.Category = 'ECOM4Future'
ghenv.Component.SubCategory = '1 :: Entities'
ghenv.Component.AdditionalHelpFromDocStrings = '2'

import Rhino.Geometry as rg

try:
    from honeybee.schedule.ruleset import ScheduleRuleset
except ImportError:
    ScheduleRuleset = None


from ECOMToolkit.entities import ElectricVehicle

# --- Main Grasshopper Logic ---

EV = ElectricVehicle(
    name, schedule, capacity, is_hybrid,
    efficiency, daily_distance, max_charging_power,
    v2g_enabled, embodied_co2, analysis_period
)
out = EV.validate()
daily_energy_demand = EV.daily_energy_demand
usable_capacity = EV.usable_capacity
total_embodied_co2 = EV.total_embodied_co2
# ---------- end electricvehicle ----------

value_list_42 = ValueList({"hourly", "fixed", "real_time"}, selected="hourly")
energy_price = EnergyPrice(pricing_mode=value_list_42, hourly_prices=nordpool_price.prices)  # -> out, report, price_data, avg_price, min_price, max_price; inputs hourly_prices: list
# ---------- energy_price: Python ----------
# Energy Price: Flexible Price Definition (MIT)
# Version: 0.0.4
# Designed for use inside Grasshopper (GH) for Rhino by ECOM4Future

"""
Define the electricity price structure for the energy community analysis.
Supports fixed price, hourly list, or real-time/day-ahead prices.

    Args:
        pricing_mode: Select pricing mode:
            - "fixed" = constant price for all hours.
            - "hourly" = list of hourly prices (any length: day, week, year).
            - "real_time" = real-time/day-ahead prices (DataFrame or CSV).
        fixed_price: (Required if mode="fixed")
            Constant electricity price in SEK/kWh. Example: 1.2
        hourly_prices: (Required if mode="hourly")
            A list or GH data tree of hourly prices (SEK/kWh).
        real_time_data: (Required if mode="real_time")
            A CSV file path or Pandas DataFrame with at least:
            ["timestamp", "price"] columns.

    Returns:
        report: Summary of the selected pricing mode and basic stats.
        price_data: Standardized price data (float, list, or DataFrame).
        avg_price: Average electricity price (SEK/kWh).
        min_price: Minimum price (SEK/kWh).
        max_price: Maximum price (SEK/kWh).
"""

ghenv.Component.Name = 'Energy Price'
ghenv.Component.NickName = 'energy_price'
ghenv.Component.Message = '0.0.4'
ghenv.Component.Category = 'ECOM4Future'
ghenv.Component.SubCategory = '5 :: Energy Community'
ghenv.Component.AdditionalHelpFromDocStrings = '2'

import csv, os

try:
    import pandas as pd
except ImportError:
    pd = None

try:
    from ladybug_rhino.grasshopper import all_required_inputs
except ImportError:
    def all_required_inputs(comp): return True  # fallback


class EnergyPrice:
    """Flexible electricity price definition."""

    def __init__(self, pricing_mode, fixed_price=None, hourly_prices=None, real_time_data=None):
        self.mode = pricing_mode.lower().strip()
        self.fixed_price = fixed_price
        self.hourly_prices = hourly_prices
        self.real_time_data = real_time_data
        self.price_data = self._parse_price_data()

    def _parse_price_data(self):
        """Standardize the price data based on the selected mode."""
        if self.mode == "fixed":
            if self.fixed_price is None:
                raise ValueError("Fixed price must be provided when mode='fixed'.")
            return float(self.fixed_price)

        elif self.mode == "hourly":
            # ✅ Convert GH trees/tuples to native Python list
            if self.hourly_prices is None:
                raise ValueError("hourly_prices must be provided when mode='hourly'.")
            if not isinstance(self.hourly_prices, list):
                try:
                    self.hourly_prices = list(self.hourly_prices)
                except Exception:
                    raise ValueError("Could not convert hourly_prices to a valid list.")
            if len(self.hourly_prices) == 0:
                raise ValueError("hourly_prices must be a non-empty list of hourly values.")
            return [float(v) for v in self.hourly_prices]

        elif self.mode == "real_time":
            if not pd:
                raise ImportError("Pandas is required for real_time mode.")
            if isinstance(self.real_time_data, str) and os.path.isfile(self.real_time_data):
                df = pd.read_csv(self.real_time_data)
            elif isinstance(self.real_time_data, pd.DataFrame):
                df = self.real_time_data.copy()
            else:
                raise ValueError("real_time_data must be a CSV path or Pandas DataFrame.")
            if not {"timestamp", "price"}.issubset(df.columns):
                raise ValueError("Real-time data must have 'timestamp' and 'price' columns.")
            df["timestamp"] = pd.to_datetime(df["timestamp"])
            df = df.sort_values("timestamp")
            return df

        else:
            raise ValueError("Invalid pricing_mode. Use 'fixed', 'hourly', or 'real_time'.")

    def avg_price(self):
        if self.mode == "fixed":
            return float(self.fixed_price)
        if self.mode == "hourly":
            return sum(self.hourly_prices) / len(self.hourly_prices)
        if self.mode == "real_time":
            return self.price_data["price"].mean()

    def min_price(self):
        if self.mode == "fixed":
            return float(self.fixed_price)
        if self.mode == "hourly":
            return min(self.hourly_prices)
        if self.mode == "real_time":
            return self.price_data["price"].min()

    def max_price(self):
        if self.mode == "fixed":
            return float(self.fixed_price)
        if self.mode == "hourly":
            return max(self.hourly_prices)
        if self.mode == "real_time":
            return self.price_data["price"].max()

    def validate(self):
        return (f"Energy Price configured successfully (Mode: {self.mode}).\n"
                f"Average: {self.avg_price():.3f} SEK/kWh | "
                f"Min: {self.min_price():.3f} | Max: {self.max_price():.3f}")


# --- Main Grasshopper Logic ---
if all_required_inputs(ghenv.Component):
    price_obj = EnergyPrice(pricing_mode, fixed_price, hourly_prices, real_time_data)
    price_data = price_obj.price_data
    report = price_obj.validate()
    avg_price = price_obj.avg_price()
    min_price = price_obj.min_price()
    max_price = price_obj.max_price()
# ---------- end energy_price ----------
panel_206 = Panel(energy_price.price_data)

point_3 = Point(Point(319626.6464, 6398341.684, 0))
number_slider_7 = Slider(10, range=0..10)
battery = Battery(
    name="Battery-01",
    capacity=Slider(54, range=0..100),
    point=point_3,
    initial_soc=Slider(5, range=0..10),
    cost=number_slider_7,
    embodied_co2=number_slider_7,
    efficiency=Slider(20, range=0..100),
    lifespan=Slider(10, range=0..10),
    degradation=Slider(2, range=0..100))  # -> out, battery, total_cost, total_embodied_co2, capacity_eol, capacity_average; inputs point: Point3d
# ---------- battery: Python ----------
# Battery: A Plugin for Energy Storage Analysis (MIT)
# Version: 0.0.2
# Designed for use inside Grasshopper (GH) for Rhino by ECOM4Future

"""
Create a Battery object representing an energy storage system.
_
Calculates total cost, total embodied carbon, and degraded capacity over lifespan.
-

    Args:
        name: Battery name or model identifier.
            Example: "Tesla Powerwall 2".
        capacity: Battery storage capacity (kWh).
            Example: 13.5.
        point: A Rhino point representing the battery location (for visualization).
        cost: Cost per kWh of storage (SEK/kWh).
            Example: 5000.
        embodied_co2: Embodied carbon per kWh of storage (kgCO2e/kWh).
            Example: 120.
        efficiency: Round-trip battery efficiency (%).
            Example: 90.
        lifespan: Expected lifespan (years).
            Example: 15.
        degradation: Annual capacity degradation (%/year, as 0-100).
            Example: 2 (for 2% per year).

    Returns:
        out: Validation message.
        battery: The Battery object.
        total_cost: Total cost of the battery (SEK).
        total_embodied_co2: Total embodied carbon of the battery (kgCO2e).
"""

ghenv.Component.Name = 'Battery'
ghenv.Component.NickName = 'Battery'
ghenv.Component.Message = '0.0.1'
ghenv.Component.Category = 'ECOM4Future'
ghenv.Component.SubCategory = '1 :: Entities'
ghenv.Component.AdditionalHelpFromDocStrings = '2'

import Rhino.Geometry as rg


from ECOMToolkit.entities import Battery
# --- Main Grasshopper Logic ---
if name and capacity and point and cost and embodied_co2 and efficiency and lifespan and degradation is not None:
    battery = Battery(name, capacity, point, cost, embodied_co2, efficiency, lifespan, degradation, initial_soc)
    out = battery.validate()
    total_cost = battery.total_cost
    total_embodied_co2 = battery.total_embodied_co2
    capacity_eol = battery.capacity_eol
    capacity_average = battery.average_capacity
# ---------- end battery ----------
panel_207 = Panel(battery.battery)

value_list_43 = ValueList({"Akademiska Hus", "Studentbostäder", "Chalmersfastigheter"}, selected="Akademiska Hus")
point_4 = Point(Point(319626.6464, 6398341.684, 0))
chargepoint = ChargePoint(
    name="CP",
    owner=value_list_43,
    point=point_4,
    capacity=Slider(61, range=0..100),
    charger_type="A",
    is_v2g=Toggle(True),
    EV=electricvehicle.EV)  # -> out, charge_point, hourlydemand
# ---------- chargepoint: Python ----------
# Charge Point: A Plugin for EV Charging Infrastructure (MIT)
# Version: 0.0.2 (Added Owner Input)
# Designed for use inside Grasshopper (GH) for Rhino by ECOM4Future

"""
Create a Charge Point object representing an EV charging station.
_

    Args:
        name: Name or identifier of the charging point.
            Example: "CP-01".
        point: Rhino Point3d for charger location.
        capacity: Maximum charging power (kW).
            Example: 11.
        charger_type: Charger type as string (e.g., "AC Level 2", "DC Fast").
        is_v2g: Boolean indicating if V2G is supported.
        EV: One or more Electric Vehicle objects connected to this charger.
        owner: Owner of the charge point. Must be one of:
            "Akademiska Hus", "Studentbostäder", "Chalmersfastigheter"

    Returns:
        report: Validation message.
        charge_point: A Charge Point object.
"""

ghenv.Component.Name = 'ChargePoint'
ghenv.Component.NickName = 'ChargePoint'
ghenv.Component.Message = '0.0.1'
ghenv.Component.Category = 'ECOM4Future'
ghenv.Component.SubCategory = '1 :: Entities'
ghenv.Component.AdditionalHelpFromDocStrings = '2'

import Rhino.Geometry as rg
from typing import List


from ECOMToolkit.entities import ChargePoint

# --- Main Grasshopper Logic ---
if name and point and capacity is not None and charger_type and is_v2g is not None and owner:
    # Ensure EV is always a list
    EV = EV if isinstance(EV, list) else [EV] if EV else []

    charge_point = ChargePoint(name, point, capacity, charger_type, is_v2g, owner, EV)
    report = charge_point.validate()
    hourlydemand = charge_point.hourlydemand
# ---------- end chargepoint ----------
panel_208 = Panel(chargepoint.hourlydemand)

hb_building_programs_39 = HBBuildingPrograms({"LargeOffice", "MediumOffice", "SmallOffice", "MidriseApartment", "HighriseApartment", "Retail", "StripMall", "PrimarySchool", "SecondarySchool", "SmallHotel", "LargeHotel", "Hospital", "Outpatient", "Laboratory", "Warehouse", "SuperMarket", "FullServiceRestaurant", "QuickServiceRestaurant", "Courthouse", "College", "LargeDataCenterHighITE", "LargeDataCenterLowITE", "SmallDataCenterHighITE", "SmallDataCenterLowITE"}, selected="College")
panel_209 = Panel("E:\DT4PED\DT4PED_Campus\Data\energy_data\07.23 SB2\electricity_2022.csv")
value_list_44 = ValueList({"Akademiska Hus", "Studentbostäder", "Chalmersfastigheter"}, selected="Studentbostäder")
brep_39 = Brep(<brep referenced from the Rhino model>)
building_39 = Building(
    name="SB2",
    owner=value_list_44,
    breps=flatten(brep_39),
    building_type=hb_building_programs_39,
    electric_demand=panel_209,
    PV_plant=pvplant_8.PV_plant)  # -> out, building, area, fractional_hourly_electric_demand, electric_demand_from_program, electric_demand, total_energy_demand, total_installed_capacity; inputs footprints: list of Curve, number_of_floors: list, breps: list, PV_plant: list; same code as building
panel_210 = Panel(building_39.building)

grid = Grid(
    analysis_period=analysisperiod.hoys,
    electricity_market_selling_price=energy_price.price_data,
    electricity_market_buying_price=energy_price.price_data,
    electricity_market_carbon_intensity=energy_price.price_data)  # -> out, report, grid; inputs analysis_period: list of Int32, electricity_market_selling_price: list, electricity_market_buying_price: list, electricity_market_carbon_intensity: list
# ---------- grid: Python ----------
# Grid: Energy Community Grid Connection (MIT)
# Version: 0.0.1
# Designed for use inside Grasshopper (GH) for Rhino by ECOM4Future

"""
Compute annual electricity balance for a Grid connection, compatible with Dragonfly.
_

    Args:
        name: Name or ID of the grid connection.
        substation: Dragonfly Substation object.
        connector: List of Dragonfly ElectricalConnector objects.
        transformer: List of Dragonfly Transformer objects.
        capacity: Maximum grid connection capacity (kW).
        building: List of Building objects (from Building component).
        charge_point: List of Charge Point objects (with EVs).
        cost_electricity: Import tariff (SEK/kWh).
        tarriffs: Export tariff (SEK/kWh).
        co2: Grid operational CO₂ factor (kgCO₂e/kWh).
        system_loss: Percentage loss in transformers/connectors (%).

    Returns:
        report: Validation message and summary of the grid balance.
        grid: Grid object (to merge component).
        electricity_import: Total imported electricity (kWh/year).
        electricity_export: Total exported electricity (kWh/year).
        total_cost: Annual grid cost (SEK/year).
        total_co2: Annual operational CO₂ emissions (kgCO₂e/year).
"""

ghenv.Component.Name = 'Grid'
ghenv.Component.NickName = 'Grid'
ghenv.Component.Message = '0.0.1'
ghenv.Component.Category = 'ECOM4Future'
ghenv.Component.SubCategory = '5 :: Energy Community'
ghenv.Component.AdditionalHelpFromDocStrings = '2'

try:
    from honeybee.typing import clean_ep_string
except ImportError:
    def clean_ep_string(value): return str(value)

try:
    from ladybug_rhino.grasshopper import all_required_inputs
except ImportError:
    def all_required_inputs(comp): return True  # fallback


from ECOMToolkit.entities import Grid

# --- Main Grasshopper Logic ---
if all_required_inputs(ghenv.Component):
    grid = Grid(electricity_market_buying_price,
                 electricity_market_selling_price,
                 electricity_market_carbon_intensity,
                 analysis_period)
    report = grid.report()
# ---------- end grid ----------
panel_211 = Panel("E:\DT4PED\DT4PED_Campus\Dashboard\public\community_json01")

gene_pool = GenePool(Decimals=0, Maximum=100, Minimum=0, Value=[100, 0, 100, 0, 0, 100, 0, 100, 0, 0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])  # disabled
residential_roof_surfaces = RemoteReceiver()  # disabled
mixeduse_roof_surfaces = RemoteReceiver()  # disabled
unflatten_tree = UnflattenTree(Guide=[mixeduse_roof_surfaces, residential_roof_surfaces])  # disabled
area_2 = Area(Geometry=[mixeduse_roof_surfaces, residential_roof_surfaces])  # -> Area, Centroid; disabled
move_4 = Move(Geometry=area_2.Centroid, Motion=Vector(0, 0, 10))  # -> Geometry, Transform; disabled
panel_212 = Panel("name")  # disabled
commercial_footprint = RemoteReceiver()  # disabled
buildings_footfprint = RemoteReceiver()  # disabled
line_2 = Line(StartPoint=area_2.Centroid, EndPoint=move_4.Geometry)  # disabled
user_text_38 = UserText(Content=[commercial_footprint, buildings_footfprint], Keys=panel_212, UserTextMode=1)  # -> Content, Keys, Values; disabled
list_length_3 = ListLength(List=[mixeduse_roof_surfaces, residential_roof_surfaces])  # disabled
roof_geometry_2 = RemoteReceiver(roof_geometry)  # disabled
run = BooleanToggle(True)  # disabled
colour_swatch_2 = ColourSwatch(SwatchColor=RGB(61, 59, 71))  # disabled
colour_swatch_3 = ColourSwatch(SwatchColor=RGB(140, 140, 140))  # disabled
duplicate_data_2 = DuplicateData(Data=user_text_38.Values, Number=list_length_3, Order=True)  # disabled
custom_preview_2 = CustomPreview(Geometry=[mixeduse_roof_surfaces, residential_roof_surfaces], Material=colour_swatch_3)  # disabled
number_slider_8 = Slider(10, range=0..100)  # disabled
panel_213 = Panel("""0
3
5
7""")  # disabled
panel_214 = Panel("Average monthly energy (2005-2020)")  # disabled
list_item_2 = ListItem(List=flatten(move_4.Geometry), Index=panel_213, Wrap=True)  # disabled
panel_215 = Panel(residential_roof_surfaces)  # disabled
number_slider_9 = Slider(738, range=0..1000)  # disabled
number_slider_10 = Slider(325, range=0..1000)  # disabled
panel_216 = Panel("Annual PV Generation (kWh)")  # disabled
boolean_toggle_7 = BooleanToggle(False)  # disabled
panel_217 = Panel("""Jan
Feb
March
April
May
June
July
Aug
Sep
Oct
Nov
Dec""")  # disabled
launch_window = LaunchWindow(
    Show=boolean_toggle_7,
    Name=panel_216,
    Width=number_slider_9,
    Height=number_slider_10,
    ChildStatus=0,
    EnableHorizScroll=False)  # disabled
panel_218 = Panel(" kWh")  # disabled
panel_219 = Panel("Monthly PV Generation")  # disabled
group_toggle = GroupToggle(ToggleActive=True, ToggleVisible=False)  # disabled

# ---- group: PV
panel_x_2 = Slider(1, range=0..10)  # disabled
panel_y_2 = Slider(2, range=0..10)  # disabled
panel_rating_kwp = Slider(0.25, range=0..1)  # disabled
panel_rating = RemoteSender(panel_rating_kwp)  # disabled
panel_x_3 = RemoteSender(panel_x_2)  # disabled
panel_y_3 = RemoteSender(panel_y_2)  # disabled
roof_percent = RemoteSender(unflatten_tree)  # disabled

# ----
cluster = Cluster(
    panel_rating=[panel_rating, residential_roof_surfaces],
    roof_geometry=[mixeduse_roof_surfaces, residential_roof_surfaces],
    panel_x=panel_x_3,
    panel_y=panel_y_3,
    roof_percent=roof_percent)  # -> tree_2, tree, panel_geometry_2; disabled
mass_addition_6 = MassAddition(Input=flatten(cluster.tree))  # -> Result, PartialResults; disabled
custom_preview_3 = CustomPreview(Geometry=cluster.panel_geometry_2, Material=colour_swatch_2)  # disabled
installed_capacity = RemoteReceiver(cluster.tree)  # disabled
panel_count = RemoteReceiver(cluster.tree_2)  # disabled
text_mapper = IronPython2Script(
    roof_percentage=flatten(roof_percent),
    installed_capacity=flatten(cluster.tree),
    panel_count=flatten(cluster.tree_2),
    name=flatten(duplicate_data_2))  # -> out, a; inputs roof_percentage: list, installed_capacity: list, panel_count: list, name: list; disabled
# ---------- text_mapper: IronPython ----------
"""Grasshopper Script"""
a = []
for i in range(len(roof_percentage)):
    rp = roof_percentage[i]
    ic = installed_capacity[i]
    pc = panel_count[i]
    n = name[i]

    text = ''
    text+='Building name: {}{}'.format(n,'\n')
    text+='Roof percentage: {}{}'.format(rp,'\n')
    text+='Panel count: {}{}'.format(pc,'\n')
    text+='Installed capacity (kWp): {}{}'.format(ic,'\n')
    a.append(text)
# ---------- end text_mapper ----------
installed_capacity_kwp = Panel(installed_capacity)  # disabled
panel_count_2 = Panel(panel_count)  # disabled
list_item_3 = ListItem(List=text_mapper.a, Index=panel_213, Wrap=True)  # disabled
annotation_dot = AnnotationDot(Location=flatten(list_item_2), PrimaryText=list_item_3, TextHeight=number_slider_8)  # -> AnnotationDot, Location, PrimaryText, SecondaryText, TextHeight, Font; disabled

# ---- group: PVGIS Monthly API
system_losses_in_percenage = Slider(14, range=0..100)  # disabled
aspect_orientation = Slider(0, range=-90..90)  # disabled
panel_220 = Panel("11.906")  # disabled
panel_221 = Panel("57.718")  # disabled
panel_222 = Panel("PVGIS-SARAH2")  # disabled
pvgis_monthly = GhPythonScript(
    lat=panel_221,
    lon=panel_220,
    raddatabase=panel_222,
    peakpower=mass_addition_6.Result,
    loss=system_losses_in_percenage,
    angle=roof_angle_2,
    aspect=aspect_orientation,
    run=run)  # -> API_Output, output, E_d, E_m, H_i_d, H_i_m, SD_m; disabled
# ---------- pvgis_monthly: Python ----------
import ghpythonlib.components as ghcomp
import Grasshopper.Kernel as gh
import urllib2
import urllib
import json

def create_warning(msg):
    """
    Adds a warning message to the Grasshopper component.
    """
    ghenv.Component.AddRuntimeMessage(gh.GH_RuntimeMessageLevel.Warning, msg)

def create_output(output):
    """
    Sets the output nickname and description.
    """
    ghenv.Component.Params.Output[0].NickName = "API Output"
    ghenv.Component.Params.Output[0].Description = "API output data"
    return output

def initialize_inputs():
    """
    Initialize component inputs if they do not exist.
    """
    if not ghenv.Component.Params.Input[0].Name == "lat":
        ghenv.Component.Params.Input[0].NickName = "lat"
        ghenv.Component.Params.Input[0].Name = "lat"
        ghenv.Component.Params.Input[0].Description = "Latitude in decimal degrees, south is negative"
        ghenv.Component.Params.Input[0].Optional = False

    if not ghenv.Component.Params.Input[1].Name == "lon":
        ghenv.Component.Params.Input[1].NickName = "lon"
        ghenv.Component.Params.Input[1].Name = "lon"
        ghenv.Component.Params.Input[1].Description = "Longitude in decimal degrees, west is negative"
        ghenv.Component.Params.Input[1].Optional = False

    if not ghenv.Component.Params.Input[2].Name == "usehorizon":
        ghenv.Component.Params.Input[2].NickName = "usehorizon"
        ghenv.Component.Params.Input[2].Name = "usehorizon"
        ghenv.Component.Params.Input[2].Description = "Calculate taking into account shadows from high horizon"
        ghenv.Component.Params.Input[2].Optional = True

    if not ghenv.Component.Params.Input[3].Name == "userhorizon":
        ghenv.Component.Params.Input[3].NickName = "userhorizon"
        ghenv.Component.Params.Input[3].Name = "userhorizon"
        ghenv.Component.Params.Input[3].Description = "Heights of the horizon at equidistant directions"
        ghenv.Component.Params.Input[3].Optional = True

    if not ghenv.Component.Params.Input[4].Name == "raddatabase":
        ghenv.Component.Params.Input[4].NickName = "raddatabase"
        ghenv.Component.Params.Input[4].Name = "raddatabase"
        ghenv.Component.Params.Input[4].Description = "Name of the radiation database"
        ghenv.Component.Params.Input[4].Optional = True

#    if not ghenv.Component.Params.Input[5].Name == "startyear":
#        ghenv.Component.Params.Input[5].NickName = "startyear"
#        ghenv.Component.Params.Input[5].Name = "startyear"
#        ghenv.Component.Params.Input[5].Description = "First year of hourly averages"
#        ghenv.Component.Params.Input[5].Optional = True
#
#    if not ghenv.Component.Params.Input[6].Name == "endyear":
#        ghenv.Component.Params.Input[6].NickName = "endyear"
#        ghenv.Component.Params.Input[6].Name = "endyear"
#        ghenv.Component.Params.Input[6].Description = "Final year of hourly averages"
#        ghenv.Component.Params.Input[6].Optional = True

    if not ghenv.Component.Params.Input[7].Name == "pvcalculation":
        ghenv.Component.Params.Input[7].NickName = "pvcalculation"
        ghenv.Component.Params.Input[7].Name = "pvcalculation"
        ghenv.Component.Params.Input[7].Description = "0 for only solar radiation, 1 for PV production estimation"
        ghenv.Component.Params.Input[7].Optional = True

    if not ghenv.Component.Params.Input[8].Name == "peakpower":
        ghenv.Component.Params.Input[8].NickName = "peakpower"
        ghenv.Component.Params.Input[8].Name = "peakpower"
        ghenv.Component.Params.Input[8].Description = "Nominal power of the PV system in kW"
        ghenv.Component.Params.Input[8].Optional = True

    if not ghenv.Component.Params.Input[9].Name == "pvtechchoice":
        ghenv.Component.Params.Input[9].NickName = "pvtechchoice"
        ghenv.Component.Params.Input[9].Name = "pvtechchoice"
        ghenv.Component.Params.Input[9].Description = "PV technology choice"
        ghenv.Component.Params.Input[9].Optional = True

    if not ghenv.Component.Params.Input[10].Name == "mountingplace":
        ghenv.Component.Params.Input[10].NickName = "mountingplace"
        ghenv.Component.Params.Input[10].Name = "mountingplace"
        ghenv.Component.Params.Input[10].Description = "Type of PV module mounting"
        ghenv.Component.Params.Input[10].Optional = True

    if not ghenv.Component.Params.Input[11].Name == "loss":
        ghenv.Component.Params.Input[11].NickName = "loss"
        ghenv.Component.Params.Input[11].Name = "loss"
        ghenv.Component.Params.Input[11].Description = "System losses in percent"
        ghenv.Component.Params.Input[11].Optional = True

    if not ghenv.Component.Params.Input[12].Name == "trackingtype":
        ghenv.Component.Params.Input[12].NickName = "trackingtype"
        ghenv.Component.Params.Input[12].Name = "trackingtype"
        ghenv.Component.Params.Input[12].Description = "Type of suntracking used"
        ghenv.Component.Params.Input[12].Optional = True

    if not ghenv.Component.Params.Input[13].Name == "angle":
        ghenv.Component.Params.Input[13].NickName = "angle"
        ghenv.Component.Params.Input[13].Name = "angle"
        ghenv.Component.Params.Input[13].Description = "Inclination angle from the horizontal plane"
        ghenv.Component.Params.Input[13].Optional = True

    if not ghenv.Component.Params.Input[14].Name == "aspect":
        ghenv.Component.Params.Input[14].NickName = "aspect"
        ghenv.Component.Params.Input[14].Name = "aspect"
        ghenv.Component.Params.Input[14].Description = "Orientation angle"
        ghenv.Component.Params.Input[14].Optional = True

    if not ghenv.Component.Params.Input[15].Name == "optimalinclination":
        ghenv.Component.Params.Input[15].NickName = "optimalinclination"
        ghenv.Component.Params.Input[15].Name = "optimalinclination"
        ghenv.Component.Params.Input[15].Description = "Calculate the optimum inclination angle"
        ghenv.Component.Params.Input[15].Optional = True

    if not ghenv.Component.Params.Input[16].Name == "optimalangles":
        ghenv.Component.Params.Input[16].NickName = "optimalangles"
        ghenv.Component.Params.Input[16].Name = "optimalangles"
        ghenv.Component.Params.Input[16].Description = "Calculate both optimal inclination and orientation angles"
        ghenv.Component.Params.Input[16].Optional = True

    if not ghenv.Component.Params.Input[17].Name == "components":
        ghenv.Component.Params.Input[17].NickName = "components"
        ghenv.Component.Params.Input[17].Name = "components"
        ghenv.Component.Params.Input[17].Description = "Output beam, diffuse, and reflected radiation components"
        ghenv.Component.Params.Input[17].Optional = True

    if not ghenv.Component.Params.Input[18].Name == "outputformat":
        ghenv.Component.Params.Input[18].NickName = "outputformat"
        ghenv.Component.Params.Input[18].Name = "outputformat"
        ghenv.Component.Params.Input[18].Description = "Output format (csv, basic, json)"
        ghenv.Component.Params.Input[18].Optional = True

    if not ghenv.Component.Params.Input[19].Name == "browser":
        ghenv.Component.Params.Input[19].NickName = "browser"
        ghenv.Component.Params.Input[19].Name = "browser"
        ghenv.Component.Params.Input[19].Description = "Use if accessing from a web browser"
        ghenv.Component.Params.Input[19].Optional = True

# Initialize inputs
initialize_inputs()


lat_default = None
lon_default = None
usehorizon_default = 1
userhorizon_default = None
raddatabase_default = "PVGIS-SARAH"  # Choose a valid default database
startyear_default = None
endyear_default = None
pvcalculation_default = 1
peakpower_default = 1
pvtechchoice_default = "crystSi"
mountingplace_default = "building"
loss_default = 14
trackingtype_default = None
angle_default = 45
aspect_default = -35
optimalinclination_default = None
optimalangles_default = None
components_default = None
outputformat_default = "json"
browser_default = 0

# Input validation and assignment
lat = lat if lat is not None else lat_default
lon = lon if lon is not None else lon_default
usehorizon = usehorizon if usehorizon is not None else usehorizon_default
userhorizon = userhorizon if userhorizon is not None else userhorizon_default
raddatabase = raddatabase if raddatabase is not None else raddatabase_default
startyear = startyear if startyear is not None else startyear_default
endyear = endyear if endyear is not None else endyear_default
pvcalculation = pvcalculation if pvcalculation is not None else pvcalculation_default
peakpower = peakpower if peakpower is not None else peakpower_default
pvtechchoice = pvtechchoice if pvtechchoice is not None else pvtechchoice_default
mountingplace = mountingplace if mountingplace is not None else mountingplace_default
loss = loss if loss is not None else loss_default
trackingtype = trackingtype if trackingtype is not None else trackingtype_default
angle = angle if angle is not None else angle_default
aspect = aspect if aspect is not None else aspect_default
optimalinclination = optimalinclination if optimalinclination is not None else optimalinclination_default
optimalangles = optimalangles if optimalangles is not None else optimalangles_default
components = components if components is not None else components_default
outputformat = outputformat if outputformat is not None else outputformat_default
browser = browser if browser is not None else browser_default

# Check for minimum obligatory inputs and add warning if missing
mandatory_inputs = {
    "Latitude": lat,
    "Longitude": lon,
    "Radiation Database": raddatabase,
    "Peak Power": peakpower,
    "Loss": loss,
    "Mounting Place": mountingplace,
    "Angle": angle,
    "Aspect": aspect
}

missing_inputs = [name for name, value in mandatory_inputs.items() if value is None]

if run:
    if missing_inputs:
        create_warning("Missing mandatory inputs: {}".format(", ".join(missing_inputs)))
        output = None
    else:
        # Construct the input dictionary
        input_params = {
            "lat": lat,
            "lon": lon,
            "usehorizon": usehorizon,
            "raddatabase": raddatabase,
            "startyear": startyear,
            "endyear": endyear,
            "pvcalculation": pvcalculation,
            "peakpower": peakpower,
            "pvtechchoice": pvtechchoice,
            "mountingplace": mountingplace,
            "loss": loss,
            "trackingtype": trackingtype,
            "angle": angle,
            "aspect": aspect,
            "optimalinclination": optimalinclination,
            "optimalangles": optimalangles,
            "components": components,
            "outputformat": outputformat,
            "browser": browser
        }
        
        # Only add 'userhorizon' if it is not empty
        if userhorizon:
            input_params["userhorizon"] = ",".join(map(str, userhorizon))
        
        # Remove any keys with None values
        input_params = {k: v for k, v in input_params.items() if v is not None}
        
        # Base URL for the API
        base_url = "https://re.jrc.ec.europa.eu/api/v5_2/PVcalc"#"https://re.jrc.ec.europa.eu/api/seriescalc"
        
        # Encode parameters into URL
        url_params = urllib.urlencode(input_params)
        full_url = "{}?{}".format(base_url, url_params)
        
# Parsing and storing each section in different variables
    try:
        # Make the API call
        response = urllib2.urlopen(full_url)
        response_data = response.read()
        
        # Decode the response based on output format
        if outputformat == "json":
            response_json = json.loads(response_data)
            output = response_json
        else:
            output = response_data
        
        # Parse and store each section in different variables
        inputs_data = response_json.get("inputs", {})
        outputs_data = response_json.get("outputs", {})
        meta_data = response_json.get("meta", {})
        
        # Store specific sections in separate variables
        location = inputs_data.get("location", {})
        meteo_data = inputs_data.get("meteo_data", {})
        mounting_system = inputs_data.get("mounting_system", {})
        pv_module = inputs_data.get("pv_module", {})
        economic_data = inputs_data.get("economic_data", {})
        
        monthly_data = outputs_data.get("monthly", {}).get("fixed", [])
        totals_data = outputs_data.get("totals", {}).get("fixed", {})
    
        # Extract the specified outputs
        E_d = [month_data["E_d"] for month_data in monthly_data]
        E_m = [month_data["E_m"] for month_data in monthly_data]
        H_i_d = [month_data["H(i)_d"] for month_data in monthly_data]
        H_i_m = [month_data["H(i)_m"] for month_data in monthly_data]
        SD_m = [month_data["SD_m"] for month_data in monthly_data]
    
    except urllib2.URLError as e:
        create_warning("API call failed: {}".format(e.reason))
        output = None
    except ValueError:
        create_warning("No JSON object could be decoded. Check if outputformat is set correctly.")
        output = response_data
    except Exception as e:
        create_warning("Unexpected error: {}".format(str(e)))
        output = None

    print("{}".format(full_url))
# ---------- end pvgis_monthly ----------

# ----
mass_addition_7 = MassAddition(Input=pvgis_monthly.E_m)  # -> Result, PartialResults; disabled
lb_monthly_data_type_formation = LBMonthlyDataTypeFormation(values=pvgis_monthly.E_m)  # disabled
panel_223 = Panel(pvgis_monthly.E_m)  # disabled
mass_addition_8 = MassAddition(Input=pvgis_monthly.E_m)  # -> Result, PartialResults; disabled
highest_lowest_numbers_2 = HighestLowestNumbers(Numbers=pvgis_monthly.E_m)  # -> Highest, Lowest; disabled
panel_224 = Panel(mass_addition_8.Result)  # disabled
gradient = Gradient(
    LowerLimit=highest_lowest_numbers_2.Lowest,
    UpperLimit=highest_lowest_numbers_2.Highest,
    Parameter=pvgis_monthly.E_m,
    stops=[0: RGB(68, 1, 84), 0.0312: RGB(70, 12, 95), 0.0625: RGB(71, 24, 106), 0.0938: RGB(72, 34, 115), 0.125: RGB(71, 44, 123), 0.156: RGB(69, 54, 129)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])  # disabled
concatenate = Concatenate(FragmentA=mass_addition_7.Result, FragmentB=panel_218)  # disabled
create_chart = CreateChart(Data=pvgis_monthly.E_m, Names=panel_217, Title=panel_219, SubTitle=concatenate, ChartType=2)  # disabled
add_elements = AddElements(Window=launch_window, Elements=flatten(create_chart), DoVLChecking=True)  # -> AddedElements, ElementNames; disabled
chart_appearance = ChartAppearance(ChartToModify=create_chart, Colors=gradient)  # disabled

# ---- group: Visualisation
monthlychart = LBMonthlyChart(data=lb_monthly_data_type_formation, global_title=panel_214)  # -> out, data_mesh, data_lines, col_lines, legend, borders, labels, y_title, title; disabled; plug-in component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

# ----
surface_10 = Surface([<surface referenced from the Rhino model> x2])
pvplant_9 = PVPlant(
    name="SB1-PV",
    surfaces=surface_10,
    PV_module=pvmodule_7.PV_module,
    percentage=Slider(50, range=0..100),
    system_loss=Slider(14, range=0..100),
    run=Toggle(True))  # -> out, report, flatten(PV_plant), azimuth, slope, number_panels, installed_capacity, total_cost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; inputs surfaces: list of Brep; same code as pvplant

mass_addition_9 = MassAddition(Input=pvplant_9.number_panels)  # -> Result, PartialResults

panel_225 = Panel(mass_addition_9.Result)

surface_11 = Surface(<surface referenced from the Rhino model>)
pvplant_10 = PVPlant(
    name="KarHus-PV",
    surfaces=surface_11,
    PV_module=pvmodule_8.PV_module,
    percentage=Slider(80, range=0..100),
    system_loss=Slider(14, range=0..100),
    run=Toggle(True))  # -> out, report, PV_plant, azimuth, slope, number_panels, installed_capacity, total_cost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; inputs surfaces: list of Brep; same code as pvplant

mass_addition_10 = MassAddition(Input=pvplant_10.number_panels)  # -> Result, PartialResults

panel_226 = Panel(mass_addition_10.Result)

hb_building_programs_40 = HBBuildingPrograms({"LargeOffice", "MediumOffice", "SmallOffice", "MidriseApartment", "HighriseApartment", "Retail", "StripMall", "PrimarySchool", "SecondarySchool", "SmallHotel", "LargeHotel", "Hospital", "Outpatient", "Laboratory", "Warehouse", "SuperMarket", "FullServiceRestaurant", "QuickServiceRestaurant", "Courthouse", "College", "LargeDataCenterHighITE", "LargeDataCenterLowITE", "SmallDataCenterHighITE", "SmallDataCenterLowITE"}, selected="College")
panel_227 = Panel("E:\DT4PED\DT4PED_Campus\Data\energy_data\07.26 SB1\electricity_2022.csv")
curve_42 = Curve(<curve referenced from the Rhino model>)
value_list_45 = ValueList({"Akademiska Hus", "Studentbostäder", "Chalmersfastigheter"}, selected="Studentbostäder")
user_text_39 = UserText(Content=curve_42, Keys="number_of_floors", UserTextMode=1)  # -> Content, Keys, Values
brep_40 = Brep([<brep referenced from the Rhino model> x3])

building_40 = Building(
    name="SB1",
    owner=value_list_45,
    breps=flatten(brep_40),
    building_type=hb_building_programs_40,
    electric_demand=panel_227,
    PV_plant=pvplant_9.PV_plant)  # -> out, building, area, fractional_hourly_electric_demand, electric_demand_from_program, electric_demand, total_energy_demand, total_installed_capacity; inputs footprints: list of Curve, number_of_floors: list, breps: list, PV_plant: list; same code as building

panel_228 = Panel(building_40.electric_demand_from_program)
panel_229 = Panel(building_40.electric_demand)
panel_230 = Panel(building_40.fractional_hourly_electric_demand)

merge_2 = Merge(
    Data1=building.building,
    Data2=building_3.building,
    Data3=building_5.building,
    Data4=building_36.building,
    Data5=building_38.building,
    Data6=building_38.building,
    Data7=building_30.building,
    Data8=building_30.building,
    Data9=building_28.building,
    Data10=building_21.building,
    Data11=building_22.building,
    Data12=building_40.building,
    Data13=building_11.building,
    Data14=building_37.building,
    Data15=building_27.building,
    Data16=building_25.building,
    Data17=building_34.building,
    Data18=building_31.building,
    Data19=building_32.building,
    Data20=building_33.building,
    Data22=building_26.building,
    Data23=building_24.building,
    Data24=building_23.building,
    Data25=building_20.building,
    Data26=building_17.building,
    Data27=building_18.building,
    Data28=building_19.building,
    Data29=building_16.building,
    Data30=building_15.building,
    Data31=building_13.building,
    Data32=building_12.building,
    Data33=building_14.building,
    Data34=building_9.building,
    Data35=building_10.building,
    Data36=building_8.building,
    Data37=building_7.building,
    Data38=building_6.building,
    Data39=building_4.building,
    Data40=building_35.building,
    Data41=building_29.building,
    Data42=building_2.building)  # -> flatten(Result)
panel_231 = Panel(merge_2)

energycommunity = EnergyCommunity(
    building=merge_2,
    PV_plant=pvplant_7.PV_plant,
    battery=battery.battery,
    charge_point=chargepoint.charge_point,
    grid=grid.grid)  # -> out, flatten(community); inputs building: list, PV_plant: list
# ---------- energycommunity: Python ----------
# Merge ECOM Entities: Energy Community Aggregator (MIT)
# Version: 0.0.3
# Designed for use inside Grasshopper (GH) for Rhino by ECOM4Future

"""
Merge all energy community entities into a single Energy Community object.
_

    Args:
        buildings: List of Building objects.
        PV_plants: (Optional) List of standalone PV Plant objects not linked to buildings.
        Battery: (Optional) List of standalone Battery objects not linked to buildings.
        charging_points: (Optional) List of Charging Point objects (with EVs already linked).
        grid_name: Name or ID of the grid connection.
        grid_capacity: Maximum grid connection capacity (kW).
        grid_tariff: Optional grid tariff or cost (SEK/kWh).

    Returns:
        report: Validation message summarizing counts of each entity.
        community: Energy Community object (dictionary-like) to be used in "create ECOM".
"""

ghenv.Component.Name = 'EnergyCommunity'
ghenv.Component.NickName = 'EnergyCommunity'
ghenv.Component.Message = '0.0.1'
ghenv.Component.Category = 'ECOM4Future'
ghenv.Component.SubCategory = '1 :: Entities'
ghenv.Component.AdditionalHelpFromDocStrings = '2'

from ECOMToolkit.entities import EnergyCommunity


# --- Main Grasshopper Logic ---
community = EnergyCommunity(building,PV_plant,battery,charge_point, None)
# ---------- end energycommunity ----------
panel_232 = Panel(energycommunity.community)

value_list_46 = ValueList({"Community": "community", "Market": "market"}, selected="Community")
number_slider_11 = Slider(0.22, range=0..1)
ecom_dispatcher = ECOMDispatcher(
    community=energycommunity.community,
    dispatch_mode=value_list_46,
    analysis_period=analysisperiod.hoys,
    community_internal_price_selling=number_slider_11,
    community_internal_price_buying=number_slider_11,
    run=Toggle(True),
    graph_path="E:\DT4PED\DT4PED_Campus\Dashboard\public\graph.json",
    save_graph=Toggle(True))  # -> out, report, hourly_dispatch, grid_import, grid_export, total_cost, total_revenue, battery_soc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; inputs analysis_period: list of Int32
# ---------- ecom_dispatcher: Python ----------
# ECOM Dispatcher: Peer-to-Peer (P2P) and Peer-to-Grid (P2G) Energy Trade Simulation
# Version: 0.1.0 (Refactored for readability, added clean hourly dispatch outputs)
# Designed for use inside Grasshopper (GH) for Rhino by ECOM4Future

"""
Simulate hourly energy dispatch in an Energy Community.

Dispatch Sequence:
    1. Building self-consumption (own photovoltaic).
    2. Peer-to-peer exchange between buildings (P2P).
    3. Community PV used to cover remaining deficits.
    4. Building and community batteries discharge.
    5. Grid imports cover remaining deficits.
    6. Surplus charges batteries if capacity available.
    7. Remaining surplus exported to the grid.

Args:
    run (bool): Toggle to execute simulation.
    community: Energy Community object (from Merge ECOM Entities).
    community_internal_price_buying (float): Price for internal community trades (buying, SEK/kWh).
    community_internal_price_selling (float): Price for internal community trades (selling, SEK/kWh).
    electricity_market_price (float, list, CSV): Market electricity price.
    electricity_market_carbon_intensity (float, list, CSV): Grid carbon intensity (gCO₂/kWh).
    dispatch_mode (str): "community" (P2P prioritized) or "market" (optimized for price).
    analysis_period (tuple): Optional [start_hour, end_hour] (0–8759).

Returns:
    report (str): Text summary of self-sufficiency, self-consumption, cost, revenue, and carbon.
    hourly_dispatch (list[dict]): Hourly flows, e.g.,
        [{"hour": 0, "pv_used": 1.2, "p2p_energy": 0.5,
          "battery_charge": 0.3, "battery_discharge": 0.0,
          "grid_import": 2.1, "grid_export": 0.0,
          "soc": {...}}]
    grid_import (float): Total grid import (kWh).
    grid_export (float): Total grid export (kWh).
    total_cost (float): Total grid cost (SEK) – if available.
    total_revenue (float): Total revenue from P2P/P2G trades (SEK) – if available.
    total_carbon_imported (float): Total CO₂ emissions from grid imports (kgCO₂) – if available.
    battery_soc (dict): Hourly state of charge for all batteries.
    scenario (dict): Summary dictionary for scenario comparison.
    kpis (object): KPIResult object with all metrics.
    graph (object): NetworkX graph of the energy flows.
"""

ghenv.Component.Name = 'ECOM Dispatcher'
ghenv.Component.NickName = 'ECOM_dispatcher'
ghenv.Component.Message = '0.0.5'
ghenv.Component.Category = 'ECOM4Future'
ghenv.Component.SubCategory = '5 :: Energy Community'
ghenv.Component.AdditionalHelpFromDocStrings = '2'

from ECOMToolkit.analysis import ECOMDispatcher

# --- Instantiate dispatcher ---
dispatcher = ECOMDispatcher(
    community=community,
    dispatch_mode=dispatch_mode,
    analysis_period=analysis_period,
    community_internal_price_buying=community_internal_price_buying,
    community_internal_price_selling=community_internal_price_selling
)

def safe_getattr(obj, attr, default):
    try:
        return getattr(obj, attr, default)
    except Exception:
        return default

# --- Grasshopper Main Logic ---
if run:
    dispatcher.run()
    kpis = dispatcher.get_kpis()  # KPIResult object

    # Hourly dispatch as list of dicts
    try:
        hourly_dispatch = dispatcher.get_hourly_dispatch()
    except AttributeError:
        hourly_dispatch = []

    # Battery SoC (if available)
    try:
        battery_soc = dispatcher.get_battery_soc()
    except AttributeError:
        battery_soc = {}

    # Cost, revenue, carbon (if available in dispatcher or KPIs)
    total_cost = safe_getattr(kpis, "total_cost", 0.0)
    total_revenue = safe_getattr(kpis, "total_revenue", 0.0)
    total_carbon_imported = safe_getattr(kpis, "total_carbon_imported", safe_getattr(kpis, "total_grid_carbon_import", 0.0))

    # Individual KPIs for GH outputs
    grid_import = safe_getattr(kpis, "total_grid_import", 0.0)
    grid_export = safe_getattr(kpis, "total_grid_export", 0.0)

    # Scenario summary with extended metrics
    scenario = {
        "dispatch_mode": dispatcher.dispatch_mode,
        "grid_import": grid_import,
        "grid_export": grid_export,
        "self_sufficiency": safe_getattr(kpis, "self_sufficiency", 0.0),
        "self_consumption": safe_getattr(kpis, "self_consumption", 0.0),
        "total_pv_used": safe_getattr(kpis, "total_pv_used", 0.0),
        "total_pv_gen": safe_getattr(kpis, "total_pv_gen", 0.0),
        "total_demand": safe_getattr(kpis, "total_demand", 0.0),
        "avg_grid_carbon_intensity": safe_getattr(kpis, "avg_grid_carbon_intensity", None),
        "total_grid_carbon_import": safe_getattr(kpis, "total_grid_carbon_import", None),
        "avg_grid_price_import": safe_getattr(kpis, "avg_grid_price_import", None),
        "avg_building_self_consumption": safe_getattr(kpis, "avg_building_self_consumption", None),
        "building_self_consumption": safe_getattr(kpis, "building_self_consumption", None),
        "total_cost": total_cost,
        "total_revenue": total_revenue,
        "total_carbon_imported": total_carbon_imported
    }

    report = dispatcher.report()
    graph = dispatcher.G

else:
    report = "Toggle 'run' to True to execute the dispatch simulation."
    hourly_dispatch = []
    grid_import = 0.0
    grid_export = 0.0
    total_cost = 0.0
    total_revenue = 0.0
    total_carbon_imported = 0.0
    battery_soc = {}
    scenario = {}
    kpis = None
    graph =None

if dispatcher.G and save_graph:
    dispatcher.export_graph_json(graph_path)
else:
    print("error something went wrong with the graph export")
# ---------- end ecom_dispatcher ----------
panel_233 = Panel(ecom_dispatcher.report)

save_community_json = Python3Script(
    community=energycommunity.community,
    file_path="E:\DT4PED\DT4PED_Campus\Dashboard\public\community_json03",
    save=Toggle(True))  # -> out, path, json
# ---------- save_community_json: Python ----------
from ECOMToolkit.analysis.save_community_json import save_community_to_json

# --- Grasshopper Inputs ---
# community: EnergyCommunity object (already available)
# file_path: Path to save JSON (string)
# save: Boolean toggle to write file

# --- Save Community to JSON ---
json_path, json_str = save_community_to_json(community, file_path, save)

if json_path:
    print(f"Community JSON saved to: {json_path}")
else:
    print(f"Community JSON not saved. Info: {json_str}")

# Optionally, output json_str to a GH panel or output variable
# ---------- end save_community_json ----------
panel_234 = Panel(save_community_json.out)

# ==== cluster Cluster
roof_geometry = ClusterInput()
panel_x = ClusterInput()
roof_percent = ClusterInput()
panel_y = ClusterInput()
panel_x_2 = RemoteReceiver(panel_x)
roof_percent_2 = RemoteReceiver(roof_percent)
roof_geometry_2 = Surface(roof_geometry)
panel_y_2 = RemoteReceiver(panel_y)
division = Division(A=roof_percent_2, B="100")
rectangle = Rectangle(roof_geometry_2)
construct_domain = ConstructDomain(DomainStart=expr("-x", division), DomainEnd=division)
offset_curve = OffsetCurve(Curve=rectangle, Distance="-0.5", Corners=1)
surface = Surface(offset_curve)
construct_domain² = ConstructDomain²(DomainU=construct_domain, DomainV=construct_domain)
trim_tree = TrimTree(Tree=surface, Depth=Slider(1, range=0..1))
isotrim = Isotrim(Surface=reparameterize(trim_tree), Domain=construct_domain²)
rectangle_2 = Rectangle(isotrim)
deconstuct_rectangle = DeconstuctRectangle(Rectangle=rectangle_2)  # -> BasePlane, XInterval, YInterval
explode = Explode(Curve=rectangle_2, Recursive=True)  # -> Segments, Vertices
number = Number(deconstuct_rectangle.YInterval)
number_2 = Number(deconstuct_rectangle.XInterval)
area = Area(Geometry=roof_geometry_2)  # -> Area, Centroid
list_item = ListItem(List=explode.Vertices, Index=Slider(0, range=0..100), Wrap=True)
deconstruct_plane = DeconstructPlane(Plane=deconstuct_rectangle.BasePlane)  # -> Origin, XAxis, YAxis, unitize(ZAxis)
division_2 = Division(A=number_2, B=panel_x_2)
division_3 = Division(A=number, B=panel_y_2)
trim_tree_2 = TrimTree(Tree=list_item, Depth=Slider(1, range=0..1))
evaluate_surface = EvaluateSurface(Surface=roof_geometry_2, Point=area.Centroid)  # -> Point, unitize(Normal), UDirection, VDirection, Frame
construct_plane = ConstructPlane(Origin=trim_tree_2, XAxis=deconstruct_plane.XAxis, YAxis=deconstruct_plane.YAxis)
param_viewer = ParamViewer(trim_tree_2)
param_viewer_2 = ParamViewer(deconstruct_plane.XAxis)
rectangle_3 = Rectangle(Plane=construct_plane, XSize=panel_x_2, YSize=panel_y_2, Radius=0)  # -> Rectangle, Length
vector_display = VectorDisplay(Anchor=area.Centroid, Vector=evaluate_surface.Normal)
multiplication = Multiplication(A=evaluate_surface.Normal, B="0.1")
rectangular_array = RectangularArray(Geometry=rectangle_3.Rectangle, Cell=rectangle_3.Rectangle, XCount=division_2, YCount=division_3)  # -> Geometry, Transform
offset_curve_2 = OffsetCurve(Curve=rectangular_array.Geometry, Distance="-0.05", Corners=1)
path_mapper = PathMapper(offset_curve_2, source="{A;B;C;D}", target="{A;B;C}")
param_viewer_3 = ParamViewer(path_mapper)
trim_tree_3 = TrimTree(Tree=offset_curve_2, Depth=Slider(2, range=0..10))
boundary_surfaces = BoundarySurfaces(Edges=path_mapper)
trim_tree_4 = TrimTree(Tree=boundary_surfaces, Depth=Slider(1, range=0..1))
list_length = ListLength(List=boundary_surfaces)  # -> flatten(Length)
panel_rating = ClusterInput()
param_viewer_4 = ParamViewer(trim_tree_4)
move = Move(Geometry=boundary_surfaces, Motion=graft(multiplication))  # -> Geometry, Transform
param_viewer_5 = ParamViewer(multiplication)
panel_rating_2 = RemoteReceiver(panel_rating)
panel_count = RemoteSender(list_length)
trim_tree_5 = TrimTree(Tree=move.Geometry, Depth=Slider(1, range=0..1))
multiplication_2 = Multiplication(A=panel_rating_2, B=panel_count)
panel_geometry = Geometry(trim_tree_5)
installed_capacity = RemoteSender(multiplication_2)
unflatten_tree = UnflattenTree(Tree=panel_count, Guide=roof_geometry)
unflatten_tree_2 = UnflattenTree(Tree=installed_capacity, Guide=roof_geometry)
panel_geometry_2 = ClusterOutput(panel_geometry)
tree = ClusterOutput(unflatten_tree_2)
tree_2 = ClusterOutput(unflatten_tree)

# ==== cluster LBMonthlyDataTypeFormation
values = ClusterInput()

# ---- group: LB Data type formation
constrtype = LBConstructDataType(name="PV generation", unit="kWh/mo")  # -> type; plug-in component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
constrheader = LBConstructHeader(data_type=constrtype)  # -> header; plug-in component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
data = LBConstructData(header=constrheader, values=values, interval="monthly")  # -> data; plug-in component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

# ----
data_2 = ClusterOutput(data)
